# Grasshopper definition toggle_cage_urdf_export_v0.ghx (Grasshopper 1.0.7)
# plug-ins: Karamba

# ----
# rebars
brep = Brep([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])

# ----
# cages
brep_2 = Brep([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])

merge = Merge(Data1=brep_2)
ghpython_script = GhPythonScript(shapes=merge)  # -> out, shape_verts, connect_edges; inputs shapes: list of Brep
# ---------- ghpython_script: Python ----------
__author__ = "yijiangh"
__version__ = "2019.03.07"

import rhinoscriptsyntax as rs
import ghpythonlib.components as ghcomp
from Rhino.Geometry import Point3d, Line
# https://developer.rhino3d.com/guides/rhinopython/ghpython-question-answer/

shape_verts = []
for i, b in enumerate(shapes):
    bbox,_ = ghcomp.BoundingBox(b)
    _, c_pt = ghcomp.Volume(bbox)
    shape_verts.append(c_pt)

connect_edges = []
for i, b in enumerate(shapes):
    for j, b_check in enumerate(shapes):
        if b == b_check:
            continue
        x_crv, x_pt = ghcomp.BrepXBrep(b, b_check)
        if x_crv or x_pt:
            connect_edges.append(Line(shape_verts[i], shape_verts[j]))
# ---------- end ghpython_script ----------

# ----
# shape_vert (corresponding to shape ids)
point = Point(ghpython_script.shape_verts)

# ----
# connectivity graph
curve = Curve(ghpython_script.connect_edges)

# ----
# start pt of rack plane
construct_point = ConstructPoint(XCoordinate=Slider(189, range=0..200), YCoordinate=0, ZCoordinate=Slider(137, range=0..350))
point_2 = Point(Point(789.7643421, 2538.513139, 704.6500366))
move = Move(Geometry=point_2, Motion=construct_point)  # -> Geometry, Transform

brep_3 = Brep(merge)
fixture_spacing = Panel("100")

# ----
# a target fixture pair
brep_4 = Brep([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])
brep_5 = Brep([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])

# ----
# rebar pick fixtures
brep_6 = Brep([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])

# ----
# rightmost line
curve_2 = Curve(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)

group = Group(Objects=brep_4)
group_2 = Group(Objects=brep_5)

# ----
# cage pick fictures
brep_7 = Brep([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])

brep_8 = Brep(brep_3)
volume = Volume(Geometry=brep_8)  # -> Volume, Centroid
series = Series(Start=0, Step=fixture_spacing, Count=Slider(10, range=0..10))
bounding_box = BoundingBox(Content=group_2, Plane=PlaneXY(0, 0, 0), UnionBox=True)  # -> Box, Box_2
bounding_box_2 = BoundingBox(Content=group, Plane=PlaneXY(0, 0, 0), UnionBox=True)  # -> Box, Box_2

# ----
# sort cages by x coords
deconstruct = Deconstruct(Point=volume.Centroid)  # -> XComponent, YComponent, ZComponent
sort_list = SortList(Keys=deconstruct.XComponent, ValuesValuesA=volume.Centroid)  # -> Keys, ValuesValuesA
sort_list_2 = SortList(Keys=deconstruct.XComponent, ValuesValuesA=brep_8)  # -> Keys, ValuesValuesA
brep_9 = Brep(sort_list_2.ValuesValuesA)
point_3 = Point(sort_list.ValuesValuesA)
list_item = ListItem(List=point_3, Index=0, Wrap=True)

unit_x = UnitX(Factor=series)
volume_2 = Volume(Geometry=bounding_box.Box)  # -> Volume, Centroid
volume_3 = Volume(Geometry=bounding_box_2.Box)  # -> Volume, Centroid
negative = Negative(Value=unit_x)
deconstruct_2 = Deconstruct(Point=volume_2.Centroid)  # -> XComponent, YComponent, ZComponent
deconstruct_3 = Deconstruct(Point=volume_3.Centroid)  # -> XComponent, YComponent, ZComponent
move_2 = Move(Geometry=curve_2, Motion=negative)  # -> Geometry, Transform
curve_3 = Curve(reparameterize(move_2.Geometry))
point_4 = Point(volume_3.Centroid)
unit_x_2 = UnitX(Factor=1)
point_5 = Point(volume_2.Centroid)
evaluate_curve = EvaluateCurve(Curve=curve_3, Parameter="0.5")  # -> Point, Tangent, Angle
xy_plane = XYPlane(Origin=Point(0, 0, 0))
vector_2pt = Vector2Pt(PointA=list_item, PointB=move.Geometry, Unitize=False)  # -> Vector, Length
point_6 = Point(volume.Centroid)
unit_y = UnitY(Factor=1)
rotate_3d = Rotate3D(Geometry=xy_plane, Angle=degrees(Slider(45, range=0..100)), Center=xy_plane, Axis=unit_x_2)  # -> Geometry, Transform
move_3 = Move(Geometry=volume.Centroid, Motion=vector_2pt.Vector)  # -> Geometry, Transform
point_7 = Point(evaluate_curve.Point)
negative_2 = Negative(Value=unit_y)
vector_2pt_2 = Vector2Pt(PointA=point_6, PointB=move_3.Geometry, Unitize=False)  # -> Vector, Length
brep_10 = Brep(brep_9)

# ----
# square cages indices
number_slider = Slider(4, range=0..10)
number_slider_2 = Slider(9, range=0..100)
addition = Addition(A=number_slider, B=1)
subtraction = Subtraction(A=Slider(13, range=0..13), B=number_slider_2)
addition_2 = Addition(A=subtraction, B=1)
series_2 = Series(Start=Slider(0, range=0..100), Step=1, Count=addition)
series_3 = Series(Start=number_slider_2, Step=1, Count=addition_2)
merge_2 = Merge(Data1=series_2, Data2=series_3)  # -> simplify(graft(Result))

construct_plane = ConstructPlane(Origin=point_7, XAxis=Vector(1, 0, 0), YAxis=unit_y)  # -> graft(Plane)
move_4 = Move(Geometry=brep_10, Motion=vector_2pt_2.Vector)  # -> Geometry, Transform

# ----
# connectivity graph
curve_4 = Curve(curve)
move_5 = Move(Geometry=curve_4, Motion=vector_2pt_2.Vector)  # -> Geometry, Transform

# ----
# cages in place
brep_11 = Brep(reverse(move_4.Geometry))

brep_12 = Brep(simplify(graft(brep_11)))
construct_path = ConstructPath(Indices=merge_2)
split_tree = SplitTree(Data=brep_12, Masks=flatten(construct_path))  # -> Positive, Negative

# ----
# if cages only
brep_13 = Brep(brep_12)

# ----
# square cages in place poses
brep_14 = Brep(brep_13)

bounding_box_3 = BoundingBox(Content=brep_14, Plane=rotate_3d.Geometry)  # -> Box, Box_2
deconstruct_brep = DeconstructBrep(Brep=bounding_box_3.Box)  # -> simplify(Faces), Edges, Vertices
list_item_2 = ListItem(List=deconstruct_brep.Faces, Index=Slider(4, range=0..11), Wrap=True)
volume_4 = Volume(Geometry=brep_13)  # -> Volume, Centroid
area = Area(Geometry=list_item_2)  # -> Area, Centroid
deconstruct_4 = Deconstruct(Point=volume_4.Centroid)  # -> XComponent, YComponent, ZComponent
number = Number(deconstruct_4.XComponent)
construct_point_2 = ConstructPoint(XCoordinate=number, YCoordinate=deconstruct_3.YComponent, ZCoordinate=deconstruct_3.ZComponent)
construct_point_3 = ConstructPoint(XCoordinate=number, YCoordinate=deconstruct_2.YComponent, ZCoordinate=deconstruct_2.ZComponent)
vector_2pt_3 = Vector2Pt(PointA=point_4, PointB=construct_point_2, Unitize=False)  # -> Vector, Length
vector_2pt_4 = Vector2Pt(PointA=point_5, PointB=construct_point_3, Unitize=False)  # -> Vector, Length
move_6 = Move(Geometry=group, Motion=vector_2pt_3.Vector)  # -> Geometry, Transform
move_7 = Move(Geometry=group_2, Motion=vector_2pt_4.Vector)  # -> Geometry, Transform
point_8 = Point(area.Centroid)
plane_origin = PlaneOrigin(Base=list_item_2, Origin=point_8)
deconstruct_plane = DeconstructPlane(Plane=plane_origin)  # -> Origin, XAxis, YAxis, ZAxis
rotate_3d_2 = Rotate3D(Geometry=plane_origin, Angle=degrees("-90"), Center=deconstruct_plane.Origin, Axis=deconstruct_plane.ZAxis)  # -> Geometry, Transform
plane = Plane(rotate_3d_2.Geometry)
brep_15 = Brep(split_tree.Negative)
match_tree = MatchTree(Tree=construct_plane, Guide=plane)

# ----
# square cages in place
brep_16 = Brep(brep_14)

orient = Orient(Geometry=brep_16, Source=plane, Target=match_tree)  # -> Geometry, Transform

# ----
# cages in pick
brep_17 = Brep(orient.Geometry)

volume_5 = Volume(Geometry=brep_16)  # -> Volume, Centroid
volume_6 = Volume(Geometry=brep_17)  # -> Volume, Centroid
point_9 = Point(volume_5.Centroid)
point_10 = Point(volume_6.Centroid)
plane_2 = Plane(match_tree)

# ----
# connectivity graph
curve_5 = Curve(move_5.Geometry)

# ----
# element pose in place
plane_origin_2 = PlaneOrigin(Base=rotate_3d_2.Geometry, Origin=point_9)
brep_18 = Brep(brep_16)

# ----
# element pose in pick
plane_origin_3 = PlaneOrigin(Base=plane_2, Origin=point_10)
brep_19 = Brep(brep_17)

plane_3 = Plane(plane_origin_3)
orient_2 = Orient(Source=plane_origin_3, Target=plane_origin_2)  # -> Geometry, Transform
bounding_box_4 = BoundingBox(Content=brep_19, Plane=plane_3)  # -> Box, Box_2
deconstruct_brep_2 = DeconstructBrep(Brep=bounding_box_4.Box)  # -> simplify(Faces), Edges, Vertices
panel = Panel("""0
2
5""")
list_item_3 = ListItem(List=deconstruct_brep_2.Faces, Index=panel, Wrap=True)  # -> simplify(graft(Item))
area_2 = Area(Geometry=list_item_3)  # -> Area, Centroid
face_normals = FaceNormals(Mesh=list_item_3)  # -> Centers, Normals
shift_paths = ShiftPaths(Data=face_normals.Normals, Offset=-1)
list_item_4 = ListItem(List=shift_paths, Index=0, Wrap=True)

# ----
# robot end effector
mesh = Mesh(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)

# ----
# gripper front
point_11 = Point([Point(-250.4729424, -0.3854389172, 453.2441406), Point(249.5269394, -0.3851957321, 453.2597046)])

vector = Vector(list_item_4)
reverse = Reverse(Vector=vector)
unit_z = UnitZ(Factor=Slider(-50, range=-50..0))
point_12 = Point(area_2.Centroid)
move_8 = Move(Geometry=point_11, Motion=unit_z)  # -> Geometry, Transform
plane_normal = PlaneNormal(Origin=point_12, ZAxis=reverse)
xy_plane_2 = XYPlane(Origin=Point(0, 0, 0))
shift_paths_2 = ShiftPaths(Data=plane_normal, Offset=-1)
average = Average(Input=move_8.Geometry)
panel_2 = Panel("""0
0
90""")
plane_origin_4 = PlaneOrigin(Base=xy_plane_2, Origin=average)
rotate_plane = RotatePlane(Plane=shift_paths_2, Angle=degrees(panel_2))
number_slider_3 = Slider(38, range=0..100)
deconstruct_plane_2 = DeconstructPlane(Plane=rotate_plane)  # -> Origin, XAxis, YAxis, ZAxis
negative_3 = Negative(Value=number_slider_3)
multiplication = Multiplication(A=number_slider_3, B=deconstruct_plane_2.XAxis)
multiplication_2 = Multiplication(A=negative_3, B=deconstruct_plane_2.XAxis)
move_9 = Move(Geometry=deconstruct_plane_2.Origin, Motion=multiplication_2)  # -> Geometry, Transform
move_10 = Move(Geometry=deconstruct_plane_2.Origin, Motion=multiplication)  # -> Geometry, Transform
line = Line(StartPoint=move_9.Geometry, EndPoint=move_10.Geometry)
length = Length(Curve=line)
division = Division(A=length, B=Slider(20, range=0..100))
round = Round(Number=division)  # -> Nearest, Floor, Ceiling
divide_curve = DivideCurve(Curve=line, Count=round.Floor, Kinks=False)  # -> Points, Tangents, Parameters
point_13 = Point(simplify(graft(deconstruct_plane_2.Origin)))
point_14 = Point(divide_curve.Points)
plane_4 = Plane(simplify(graft(rotate_plane)))
vector_2pt_5 = Vector2Pt(PointA=point_13, PointB=point_14, Unitize=False)  # -> Vector, Length
move_11 = Move(Geometry=plane_4, Motion=vector_2pt_5.Vector)  # -> Geometry, Transform
panel_3 = Panel("""0
180""")
rotate_plane_2 = RotatePlane(Plane=simplify(graft(move_11.Geometry)), Angle=degrees(panel_3))
plane_5 = Plane(rotate_plane_2)
shift_paths_3 = ShiftPaths(Data=plane_5, Offset="-1")
plane_6 = Plane(shift_paths_3)
orient_3 = Orient(Source=plane_origin_4, Target=plane_6)  # -> Geometry, Transform
transform = Transform(Geometry=mesh, Transform=orient_3.Transform)

# ----
# EE preview in pick
mesh_2 = Mesh(transform)

list_length = ListLength(List=panel_2)
transform_2 = Transform(orient_2.Transform)
duplicate_data = DuplicateData(Data=transform_2, Number=list_length, Order=True)  # -> simplify(graft(Data))
mesh_3 = Mesh(transform)
mesh_4 = Mesh(mesh_2)
tree_statistics = TreeStatistics(Tree=mesh_4)  # -> Paths, Length, Count
transform_3 = Transform(Geometry=mesh_3, Transform=duplicate_data)
mesh_5 = Mesh(transform_3)
deconstruct_path = DeconstructPath(Branch=tree_statistics.Paths)  # -> simplify(Indices)
list_item_5 = ListItem(List=deconstruct_path, Index=0, Wrap=True)
create_set = CreateSet(List=flatten(list_item_5))  # -> Set, Map
list_item_6 = ListItem(List=create_set.Set, Index=Slider(0, range=0..13), Wrap=False)
concatenate = Concatenate(B="{", Fragment_A=list_item_6, A=";", Fragment_B="*", C="}")

# ----
# grasp poses in pick
plane_7 = Plane(shift_paths_3)

transform_4 = Transform(Geometry=plane_7, Transform=duplicate_data)
split_tree_2 = SplitTree(Data=mesh_4, Masks=flatten(concatenate))  # -> Positive, Negative
split_tree_3 = SplitTree(Data=mesh_5, Masks=flatten(concatenate))  # -> Positive, Negative

# ----
# grasp poses in place
plane_8 = Plane(transform_4)

point_15 = Point(point)
brep_20 = Brep(brep_11)

# ----
# verts in connectivity graph
point_16 = Point(point_15)

brep_21 = Brep(brep_20)
brep_22 = Brep(simplify(graft(brep_21)))
point_17 = Point(point_16)
group_3 = Group(Objects=brep_22)
ghpython_script_2 = GhPythonScript()  # -> out, sub_graph_lines; inputs sub_graph_vertices: list of Point3d, full_graph_lines: list of Curve; disabled
# ---------- ghpython_script_2: Python ----------
import ghpythonlib.components as ghcomp

from compas.datastructures import Network
from compas.geometry import Point, Line
from compas.geometry import distance_point_point
from compas_ghpython import xdraw_lines
from timber_workshop_robarch.utilities import *

###########################
def subgraph_from_vertices(net, vert_ids):
    """
    Simply sweep over the edge set.
    
    Parameters
    ----------
    net: compas.ds.Network
    vert_ids: a list of vert ids
    
    Returns
    -------
    """
    edge_list = []
    for e in net.edges():
        u, v = e
        if (u in vert_ids) and (v in vert_ids):
            edge_list.append((u,v))
        
#    vert_list = [net.vertex_coordinates(id) for id in vert_ids]
    
    return Network.from_vertices_and_edges(net.to_points(), edge_list)

###########################

input_lines = []
for crv in full_graph_lines:
    end_pt_1, end_pt_2 = ghcomp.EndPoints(crv)
    # convert rhino pt to compas pt
    input_lines.append([rPt2cPt(end_pt_1), rPt2cPt(end_pt_2)])
    
sub_vert = [rPt2cPt(p) for p in sub_graph_vertices]
net = Network.from_lines(input_lines)

sub_vert_ids = []
for i in range(net.number_of_vertices()):
    for t in sub_graph_vertices:
        if distance_point_point(net.vertex_coordinates(i), t) < 1e-3:
            sub_vert_ids.append(i)

sub_net = subgraph_from_vertices(net, sub_vert_ids)
#print(sub_net.to_points())
sub_graph_lines = get_network_rhino_axes(sub_net)

#xdraw_lines(sub_graph_lines)
#sub_graph = Network.from_vertices_and_edges(sub_vert, sub_vert_ids)
# ---------- end ghpython_script_2 ----------
data = Data(group_3)
ungroup = Ungroup(Group=data)  # -> simplify(Objects)
ghpython_script_3 = GhPythonScript()  # -> out, a
# ---------- ghpython_script_3: Python ----------
__author__ = "harry"
__version__ = "2019.07.04"

import rhinoscriptsyntax as rs

f = 's_' + str(1)
print f
# ---------- end ghpython_script_3 ----------
mesh_brep = MeshBrep(
    Brep=ungroup,
    Settings={GridMaxCount=0, GridMinCount=16, JaggedSeams=False, MaxEdgeLength=0, MinEdgeLength=0.0001, MinTolerance=0, Refine=True, RefineAngle=0, RelativeTolerance=0.65, SimplePlanes=True, Tolerance=0})
plane_9 = Plane(plane_7)

# ----
# base frame
xy_plane_3 = XYPlane(Origin=Point(0, 0, 0))

# ----
# world from pick grasp poses
plane_10 = Plane(plane_9)
shift_paths_4 = ShiftPaths(Data=plane_10, Offset=-1)

# ----
# shape meshes
# (aligned w/ verts)
mesh_6 = Mesh(mesh_brep)

mesh_7 = Mesh(flatten(mesh_6))

panel_4 = Panel("D:\Dropbox (MIT)\Projects\Choreo\Software\picknplace\urdf_exporter\objs\")
py_bake = PythonScript(active=Button(), path_out=panel_4, file_prefix="TestExport", file_suffix=".obj")  # -> out, object_guid; inputs geo: list; disabled
# ---------- py_bake: Python ----------
import os
import rhinoscriptsyntax as rs
import scriptcontext
import Rhino

#----------------functions----------------
def ExportAsObj(id, obj, filePath, file_prefix, file_suffix):
    #filepath = "C:\Test\TestExport.obj"
    if not os.path.isdir(filePath):
        os.mkdir(filePath)
    fileFullPath = filePath + file_prefix + '_' + str(id) + file_suffix
    
    write_options = Rhino.FileIO.FileWriteOptions()
    write_options.WriteSelectedObjectsOnly = True
    
    # select the object
    obj.Select(True)
    
    obj_options = Rhino.FileIO.FileObjWriteOptions(write_options)
    obj_options.UseSimpleDialog = True
    obj_options.CreateNgons = False
    obj_options.MapZtoY = False
    obj_options.ExportNormals = True
    obj_options.ExportMaterialDefinitions = False
    
    # texture stuff
    obj_options.ExportTcs = False
    obj_options.ExportVcs = False
    
    #obj_options.ObjGroupNames = 1

    rc = Rhino.FileIO.FileObj.Write(fileFullPath, Rhino.RhinoDoc.ActiveDoc, obj_options)
    if rc == Rhino.PlugIns.WriteFileResult.Success:
        print "Success, file saved:", fileFullPath
    else:
        print "Error saving file:", fileFullPath
    
    # de-select the object
    obj.Select(False)
##########################################

if active:
    for i, geo in enumerate(geo): 
        #we create or use some geometry
        geo_id = geo # or rs.AddLine((0,1,2), (9,8,7))
        
        #(we could do all operations here...
        
        scriptcontext.doc = ghdoc
        #we obtain the reference in the Rhino doc
        doc_object = rs.coercerhinoobject(geo_id)
        print('the type of odc_object is: ' + str(type(doc_object)))
        
        attributes = doc_object.Attributes
        print('the type of attributes is: ' + str(type(attributes)))
        geometry = doc_object.Geometry
        print('the type of geometry is: ' + str(type(geometry)))
        
        #we change the scriptcontext
        scriptcontext.doc = Rhino.RhinoDoc.ActiveDoc
        
        #we add both the geometry and the attributes to the Rhino doc
        rhino_geo_id = scriptcontext.doc.Objects.Add(geometry, attributes)
        rhino_geo = scriptcontext.doc.Objects.Find(rhino_geo_id)
        print('the Rhino doc ID is: ' + str(rhino_geo_id))
        
#        if export:
        ExportAsObj(i, rhino_geo, path_out, file_prefix, file_suffix)

#we put back the original Grasshopper document as default
scriptcontext.doc = ghdoc
# ---------- end py_bake ----------
panel_5 = Panel(py_bake.out)

list_item_7 = ListItem(List=mesh_7, Index=Slider(0, range=0..9), Wrap=True)
panel_6 = Panel("C:\Users\harry\Documents\compas-dev\compas_fab\tests\assembly\gh_prototypes\rebar_cages_assembly-picknplace-toggle")
plane_11 = Plane(plane_origin_3)
tree_statistics_2 = TreeStatistics(Tree=plane_11)  # -> Paths, Length, Count
plane_12 = Plane(plane_origin_2)

# ----
# network verts and edges
point_18 = Point(point_17)

generate_pkg = Button()
plane_13 = Plane(flatten(plane_12))
plane_14 = Plane(flatten(plane_11))
series_4 = Series(Start="0", Step=1, Count=tree_statistics_2.Count)
ghpython_script_4 = GhPythonScript(
    element_geometries=mesh_6,
    world_from_place_poses=plane_13,
    world_from_pick_poses=plane_14,
    world_from_pick_grasp_poses=shift_paths_4,
    base_frame=xy_plane_3,
    file_path=panel_6,
    pkg_name="toggle_rebar_cage_1",
    assembly_type="picknplace",
    unit="millimeter",
    generate=generate_pkg,
    predefined_sequence=series_4)  # -> out, simplify(a), b, c, d; inputs network_vertices: list of Point3d, virtual_joint_connected_e_ids: tree, element_geometries: tree of Mesh, world_from_place_poses: list of Plane, world_from_pick_poses: list of Plane, world_from_pick_grasp_poses: tree of Plane, base_frame: Plane, generate: Boolean, predefined_sequence: list
# ---------- ghpython_script_4: Python ----------
import sys
import copy
import os
import json
from collections import OrderedDict

import Rhino.Geometry as rg
import ghpythonlib.components as ghcomp
import ghpythonlib.treehelpers as th

from compas.datastructures import Mesh
from compas.geometry import Frame, Point
from compas.geometry import Transformation, transform_points, cross_vectors
from compas_ghpython.utilities import draw_mesh, draw_frame

from compas_ghpython.utilities import unload_modules
unload_modules('compas_fab.assembly.datastructures')

from compas_fab.assembly.datastructures.assembly import Assembly
from compas_fab.assembly.datastructures.element import Element
from compas_fab.assembly.datastructures.virtual_joint import VirtualJoint
from compas_fab.assembly.datastructures.utils import transform_cmesh, transform_cmesh_to_origin

##########################################
def tree_to_lists(input):
    """converts a depth-2 GH datatree to a list of lists
    """
    all = []
    for path in input.Paths:
        branch_list = []
        for obj in input.Branch(path):
            branch_list.append(obj)
        all.append(branch_list)
    return all

def rPt2cPt(rPt):
    """
    Convert Rhino point to compas point
    :param rPt:
    :return:
    """
    return Point(rPt.X, rPt.Y, rPt.Z)

def rPln2cFrame(rplane):
    """converts a rhino plane to compas frame
    """
    return Frame(rplane.Origin, rplane.XAxis, rplane.YAxis)

def rMesh2cMesh(rg_mesh):
    if type(rg_mesh) == rg.Mesh:
        #single mesh
        compas_mesh_vertices = rg_mesh.Vertices.ToPoint3dArray()
        compas_mesh_faces = rg_mesh.Faces.ToIntArray(True)
        compas_mesh_faces = [compas_mesh_faces[i:i + 3] for i in range(0, len(compas_mesh_faces), 3)]
        return Mesh.from_vertices_and_faces(compas_mesh_vertices, compas_mesh_faces)
    else:
        #array of meshes
        meshes = []
        for m in rg_mesh:
            compas_mesh_vertices = m.Vertices.ToPoint3dArray()
            compas_mesh_faces = m.Faces.ToIntArray(True)
            compas_mesh_faces = [compas_mesh_faces[i:i + 3] for i in range(0, len(compas_mesh_faces), 3)]
            meshes.append( Mesh.from_vertices_and_faces(compas_mesh_vertices, compas_mesh_faces) )
        return meshes


def draw_assembly_object_cmeshes(asm, e_id, stage='place'):
    """
    Parameters:
        stage: flag for 'place', 'pick'
    """
    if stage == 'place':
        return [draw_mesh(*cm.to_vertices_and_faces()) for cm in asm.element_geometry_in_place_pose(e_id)]
    elif 'pick':
        return [draw_mesh(*cm.to_vertices_and_faces()) for cm in asm.element_geometry_in_pick_pose(e_id)]
    else:
        return None

##########################################
# main

# TODO: convert tree of e_ids into virtual joints

asm = Assembly()

# create assembly objects
e_geos = tree_to_lists(element_geometries)
grasp_pose_lists = tree_to_lists(world_from_pick_grasp_poses)

for id, rm_list in enumerate(e_geos):
    e = Element(id)
    e.world_from_element_place_pose = rPln2cFrame(world_from_place_poses[id])
    e.world_from_element_pick_pose = rPln2cFrame(world_from_pick_poses[id])
    
    cgrasp_poses = [rPln2cFrame(gpose) for gpose in grasp_pose_lists[id]]
    e.set_grasp_poses_from_in_scene_poses(e.world_from_element_pick_pose, cgrasp_poses)
    cmesh_list = []
    cmesh_list = [transform_cmesh_to_origin(rMesh2cMesh(rm), e.world_from_element_place_pose) for rm in rm_list]
    asm.add_element(e, id, cmesh_list)

asm.save_to_assembly_planning_pkg(file_path, pkg_name, assembly_type, model_type, unit, predefined_sequence)

#e = asm.get_element(1)
#a = draw_frame(e.world_from_element_place_pose)
#b = draw_frame(e.world_from_element_pick_pose)
#c = [draw_frame(pose) for pose in e.obj_from_grasp_poses]

#a = draw_assembly_object_cmeshes(asm, 0, 'place')
#b = draw_assembly_object_cmeshes(asm, 0, 'pick')
#c = [draw_mesh(*cm.to_vertices_and_faces()) for cm in asm._element_geometries['e_0']]
#d = [draw_mesh(*cm[0].to_vertices_and_faces()) for cm in asm._element_geometries.values()]

#if generate:
#    assembly_net.save_to_stripstream_pkg(file_path, pkg_name, assembly_type, model_type, unit)

## inspect vertices in neighborhood
#v_id = 1
#v_nbhd = assembly_net.vertex_neighborhood(v_id)
#for v in v_nbhd:
#    as_o_nbgh = assembly_net.get_vertex_attribute(v, "assembly_object")
#    a.extend(draw_assembly_object_cmeshes(as_o_nbgh))
#    
#b = draw_assembly_object_cmeshes(assembly_net.get_vertex_attribute(v_id, "assembly_object"))
# ---------- end ghpython_script_4 ----------
# Note:
# Not sure which one is better:
# 1. ee_pose from scene
# 2. ee_pose from object pose
number_slider_4 = Slider(9, range=0..9)
ghpython_script_5 = GhPythonScript()  # -> out, a
# ---------- ghpython_script_5: Python ----------
## Frame example
from compas.geometry import Frame
from compas.geometry.xforms import Transformation
from compas.geometry import transform_points
from compas_ghpython import draw_points, draw_frame

point = (0.0, 0.0, 63.0)
xaxis = (1.0, 0.0, 0.0)
yaxis = (0.0, 1.0, 0.0)
F1 = Frame(point, xaxis, yaxis)
a = [draw_frame(F1)]

point = (146.00, 150.00, 161.50)
xaxis = (0.9767, 0.0010, -0.214)
yaxis = (0.1002, 0.8818, 0.4609)
F2 = Frame(point, xaxis, yaxis)
a.append(draw_frame(F2))

a = []
P1 = (35., 35., 35.)
a += draw_points([{'pos': P1}])
world = Frame.worldXY()
Tw = Transformation.from_frame_to_frame(world, F1)
Pw = transform_points([P1], Tw)
a += draw_points([{'pos': Pw[0]}])
T = Transformation.from_frame_to_frame(F1, F2)
P2 = transform_points(Pw, T)
a += draw_points([{'pos': P2[0]}])
# ---------- end ghpython_script_5 ----------
panel_7 = Panel(ghpython_script_5.a)
list_item_8 = ListItem(List=ghpython_script_4.d, Index=number_slider_4, Wrap=True)
data_2 = Data(ghpython_script_4.a)
panel_8 = Panel(ghpython_script_4.a)

# ----
# archive
ghpython_script_6 = GhPythonScript()  # -> out, a; disabled
# ---------- ghpython_script_6: Python ----------
"""Creates an AssemblyNetwork and creates a problem instance pkg for stripstream
    
    Inputs
    ------
    network_lines: a list of rg.Curve
    network_vertices: a list of rg.Point3d
        this list must be indexed correponding to the tree branch in
        assembly objects
    assembly_objects: a DataTree of rg.Mesh
    
    assembly_object_poses:
        
    world_from_grasp_pose
    Outputs
    -------
        a: The a output variable"""

__author__ = "yijiangh"
__version__ = "2019.01.26"

import sys
import copy
import os
import json
from collections import OrderedDict

import Rhino.Geometry as rg
import ghpythonlib.components as ghcomp
import ghpythonlib.treehelpers as th

from compas.datastructures import Mesh, Network
from compas.geometry import Frame, Point
from compas.geometry import Transformation, transform_points, cross_vectors
from compas_ghpython import xdraw_mesh, xdraw_frame

# some useful rg<->compas conversion util fns
from timber_workshop_robarch.utilities import *

##########################################
def tree_to_lists(input):
    """converts a depth-2 GH datatree to a list of lists
    """
    all = []
    for path in input.Paths:
        branch_list = []
        for obj in input.Branch(path):
            branch_list.append(obj)
        all.append(branch_list)
    return all

def rPln2cFrame(rplane):
    """converts a rhino plane to compas frame
    """
    return Frame(rplane.Origin, rplane.XAxis, rplane.YAxis)

def transform_cmesh(cmesh, ctf):
    """transform a compas mesh
    Paramters
    ---------
    cmesh: a compas mesh
    ctf: a compas transformation
    """
    verts, faces = cmesh.to_vertices_and_faces()
    for i, v in enumerate(verts):
        v_tf = transform_points([v], ctf)[0]
        cmesh.set_vertex_attributes(i, ['x','y','z'], v_tf)
    return cmesh

def network_from_rg_pts_and_lines(vertices, lines, tol=1e-3):
    """create a compas network using given rhino pts and lines
    
    Paramters
    ---------
    vertices: list of rh.point3d
    edges: list of rh.curve
    
    Returns
    -------
    """
    net_lines = []
    for crv in lines:
        rg_end_pt_1, rg_end_pt_2 = ghcomp.EndPoints(crv)
        end_1_id = -1
        end_2_id = -1
        
        # convert rhino pt to compas pt
        for v_id, v in enumerate(vertices):
            if rg_end_pt_1.DistanceTo(v) < tol:
                end_1_id = v_id
            if rg_end_pt_2.DistanceTo(v) < tol:
                end_2_id = v_id
        
        assert((end_1_id != -1) \
        and (end_2_id != -1) \
        and (end_1_id != end_2_id))
        
        net_lines.append((end_1_id, end_2_id))
    
    cp_verts = [rPt2cPt(rpt) for rpt in vertices]
    return Network.from_vertices_and_edges(cp_verts, net_lines)
    
def draw_assembly_object_cmeshes(as_o, stage="place"):
    """
    Parameters:
        as_o: AssemblyObject
        stage: flag for 'place', 'pick'
    """
    if stage == "place":
        return [xdraw_mesh(*cm.to_vertices_and_faces()) for cm in as_o.shape_in_place_pose]
    elif "pick":
        return [xdraw_mesh(*cm.to_vertices_and_faces()) for cm in as_o.shape_in_pick_pose]
    else:
        return None

##########################################
WORLD_FRAME = Frame.worldXY()

class AssemblyObject(object):
    """assembly object that embodies geometry, geometry pose, grasp pose
    
    Attributes
    ----------
    base_frame: compas.geometry.Frame
        The frame that the data is associated with/described in.
        Defaults to be the 'base_link' (world xyz).
    id: string
        The id of the object, usually an int index of the object
    shape: compas.geometry.Mesh
        The assembly object's geometry, the mesh vertices coordinates are
        associated to the 'base_link' (world xyz)
    shape_pick_pose: compas.geometry.Frame
        The shape's pose to be picked described in the associated base_frame
    shape_place_pose: compas.geometry.Frame 
        The shape's pose to be placed described in the associated base_frame
    shape_time_stamped_pose: dict{float : compas.geometry.Frame}
        current shape pose
    object_from_ee_poses: list of compas.geometry.Frame
        The end effector (ee/gripper) grasp poses described in the object's 
        shape_pose frame.
    """
    
    def __init__(self, base_frame=WORLD_FRAME, id=-1, \
        shape=None, shape_place_pose=None):
        """
        
        Parameters
        ----------
            base_frame: compas.geometry.Frame
                Defaults to the world xyz
            id: int
                Defaults to be -1
            shape: compas.geometry.Mesh
                Defaults to be None
        """
        self.base_frame = base_frame
        self.id = id
        self.shape = shape
        self.shape_place_pose = None
        self.shape_pick_pose = None
        
    # --------------
    # constructors
    # --------------
    @classmethod
    def create_from_object_place_pose(cls, id, rbase_frame, \
            rgeometry_in_scene, rpose_in_scene):
        """create object from geometry in a scene pose
        
        We perform transformation here to orient the geometry back to
        the base_link
        
        Parameters
        ----------
        rbase_frame : rhion plane
        rgeometry_in_scene: list of rhino meshes
        rpose_in_scene: rhino planes
        """
        as_obj = cls()
        as_obj.base_frame = rPln2cFrame(rbase_frame)
        as_obj.shape_place_pose = rPln2cFrame(rpose_in_scene)
        
        # perform transformation on the geometry_in_scene
        obj_tf = Transformation.from_frame(as_obj.shape_place_pose)
        
        cmesh_tf = [transform_cmesh(rMesh2cMesh(rm), obj_tf.inverse()) \
                for rm in rgeometry_in_scene]
        
        as_obj.shape = cmesh_tf
        
        return as_obj
        
    # --------------
    # attributes assigners
    # --------------
    def set_pick_in_scene_pose(self, rpick_plane):
        self.shape_pick_pose = rPln2cFrame(rpick_plane)
        
    def set_place_in_scene_pose(self, rplace_plane):
        self.shape_place_pose = rPln2cFrame(rplace_plane)
        
    def set_ee_poses_from_in_scene_poses(self, rworld_from_obj_pose, rworld_from_ee_poses):
        """create obj_from_grasp poses from world
        
        Parameters
        ----------
        rworld_from_obj_pose: rhino plane
        rworld_from_ee_poses: a list of rhino plane
        """
        world_obj_tf = Transformation.from_frame( \
            rPln2cFrame(rworld_from_obj_pose))
        
        self.object_from_ee_poses = []
        for world_ee_fr in [rPln2cFrame(rw_ee) for rw_ee in rworld_from_ee_poses]:
            w_ee_tf = Transformation.from_frame(world_ee_fr)
            self.object_from_ee_poses.append(Frame.from_transformation( \
                Transformation.concatenate(world_obj_tf.inverse(), w_ee_tf)))
                
        
    def set_ee_place_poses_from_obj(self, obj_from_ee_poses):
        assert(False, "not implemented")
    
    @property
    def world_from_pick_ee_poses(self):
        """return a list of (world_from) ee pick poses
        """
        assert(self.shape_pick_pose != None, "pick pose not defined!")
        world_from_ee_pick = []
        world_pick_tf = Transformation.from_frame(self.shape_pick_pose)
        for obj_from_ee in self.object_from_ee_poses:
            w_f_ee_tf = Transformation.concatenate(world_pick_tf, Transformation.from_frame(obj_from_ee))
            world_from_ee_pick.append(Frame.from_transformation(w_f_ee_tf))
        return world_from_ee_pick
    
    @property
    def world_from_place_ee_poses(self):
        """return a list of (world_from) ee place poses
        """
        assert(self.shape_place_pose != None, "place pose not defined!")
        world_from_ee_place = []
        world_place_tf = Transformation.from_frame(self.shape_place_pose)
        for obj_from_ee in self.object_from_ee_poses:
            w_f_ee_tf = Transformation.concatenate(world_place_tf, Transformation.from_frame(obj_from_ee))
            world_from_ee_place.append(Frame.from_transformation(w_f_ee_tf))
        return world_from_ee_place
        
    @property
    def shape_in_pick_pose(self):
        """return shape geometries in pick pose"""
        assert(self.shape_pick_pose != None, "pick pose not defined!")
        world_pick_tf = Transformation.from_frame(self.shape_pick_pose)
        return [transform_cmesh(cm, world_pick_tf) for cm in self.shape]
#        return [cm for cm in self.shape]
    
    @property
    def shape_in_place_pose(self):
        """return shape geometries in pick pose"""
        assert(self.shape_place_pose != None, "place pose not defined!")
        world_place_tf = Transformation.from_frame(self.shape_place_pose)
        return [transform_cmesh(cm, world_place_tf) for cm in self.shape]
        
class AssemblyNetwork(Network):
    """
    
    Attributes
    ----------
        
    """
    def __init__(self):
        super(AssemblyNetwork, self).__init__()
    
    # --------------
    # constructors
    # --------------
    @classmethod
    def from_network(cls, net):
        as_net = cls()
        as_net.vertex = net.vertex 
        as_net.edge = net.edge
        as_net.halfedge = net.halfedge
        as_net.attributes = net.attributes
        return as_net
        
    @classmethod
    def from_network_and_assembly_objects(cls, net, objs):
        assert(net.number_of_vertices()==len(objs), \
            "assembly objects and network vertices not aligned!")
        as_net = cls.from_network(net)
        
        # assign assembly object attribute
        for i, vert_key in enumerate(as_net.vertices()):
            objs[i].id = i
            as_net.set_vertex_attribute(vert_key, "assembly_object", objs[i])
        return as_net
    
    # --------------
    # properties getters
    # --------------
    @property
    def assembly_objects(self):
        return [self.get_vertex_attribute(v, "assembly_object") \
            for v in self.vertices()]
    
    def assembly_object(self, vert_id):
        return self.assembly_objects[vert_id]
        
    # --------------
    # exporters
    # --------------
    def save_assembly_object_to_objs(self, mesh_path):
        if not os.path.isdir(mesh_path):
            os.mkdir(mesh_path)
            
        for as_obj in self.assembly_objects:
            for i, s in enumerate(as_obj.shape):
                s.to_obj(os.path.join(mesh_path, obj_name(as_obj.id, i)))
        
    def save_assembly_network_to_json(self, json_path, pkg_name='', \
            assembly_type='', model_type='', unit=''):
        if not os.path.isdir(json_path):
            os.mkdir(json_path)
        
        json_file_path = os.path.join(json_path, pkg_name + '.json')
        
        data = OrderedDict()
        data['pkg_name'] = pkg_name
        data['assembly_type'] = assembly_type
        data['model_type'] = model_type
        data['unit'] = unit
        
        data['element_number'] = self.number_of_vertices()
        data['sequenced_elements'] = []
        
        for v in self.vertices():
            assert(v == self.assembly_object(v).id)
            ao = self.assembly_object(v)
            
            e_data = OrderedDict()
            e_data['order_id'] = v
            e_data['base_frame'] = cframe2json(ao.base_frame)
            e_data['element_geometry_file_names'] = [obj_name(v, sub_id) \
                for sub_id in range(len(ao.shape))]
            
            grasp_data = OrderedDict()
            grasp_data['parent_link'] = 'object' #world
            grasp_data['ee_poses'] = [cframe2json(ee_p) \
                for ee_p in ao.object_from_ee_poses]
            
            pick = OrderedDict()
            pick['process_name'] = 'pick'
            pick['base_frame'] = cframe2json(ao.base_frame)
            pick['target_pose'] = cframe2json(ao.shape_pick_pose)
            pick['allowed_collision_obj_names'] = [] # support tables
            
            place = OrderedDict()
            place['process_name'] = 'place'
            place['base_frame'] = cframe2json(ao.base_frame)
            place['target_pose'] = cframe2json(ao.shape_place_pose)
            place['allowed_collision_obj_names'] = [] # support tables
            for nghb_id in self.vertex_neighborhood(v):
                place['allowed_collision_obj_names'].extend(
                    [obj_name(nghb_id, sub_id) \
                        for sub_id in range(len(self.assembly_object(nghb_id).shape))])
            
            grasp_data['processes'] = [pick, place]
            e_data['grasps'] = grasp_data
            
            data['sequenced_elements'].append(e_data)
        
        with open(json_file_path, 'w') as outfile:  
            json.dump(data, outfile, indent=4)
            
    def save_assembly_network_to_urdf(self, urdf_path):
        pass
        
    def save_to_stripstream_pkg(self, save_path, pkg_name, \
        assembly_type="", model_type="", unit=""):
        root_path = os.path.join(save_path, pkg_name)
        if not os.path.isdir(root_path):
            os.mkdir(root_path)
        
        json_path = os.path.join(root_path, "json")
        mesh_path = os.path.join(root_path, "meshes", "collision")
        urdf_path = os.path.join(root_path, "urdf")
        check_paths = [json_path, mesh_path, urdf_path]
        for p in check_paths:
            if not os.path.isdir(p):
                os.mkdir(p)
                
        # generate obj files
        self.save_assembly_object_to_objs(mesh_path)
        
        # generate json
        self.save_assembly_network_to_json(json_path, pkg_name, assembly_type, model_type, unit)
        
        # genereate urdf
#        self.save_assembly_network_to_urdf(urdf_path)

########################################
# main
a = []
b = []
c = []

# temp drawing
tf_meshes = []

line_net = network_from_rg_pts_and_lines(network_vertices, network_lines)
#a = get_network_rhino_axes(line_net)

# create assembly objects
obj_lists = tree_to_lists(assembly_objects)
grasp_pose_lists = tree_to_lists(world_from_grasp_poses)
as_objs = []

for i, obj_list in enumerate(obj_lists):
    as_obj = AssemblyObject.create_from_object_place_pose( \
        str(i), base_frame,
        obj_list, world_from_place_poses[i])
    as_obj.set_pick_in_scene_pose(world_from_pick_poses[i])
    as_obj.set_ee_poses_from_in_scene_poses(world_from_place_poses[i], grasp_pose_lists[i])
    
    as_objs.append(as_obj)

as_o = as_objs[0]
#print(as_o.shape_pick_pose.to_data())
#a = xdraw_frame(as_o.shape_pick_pose)
#b = [xdraw_mesh(*cm.to_vertices_and_faces()) for cm in as_o.shape_in_pick_pose]
#c = [xdraw_frame(ee) for ee in as_o.world_from_pick_ee_poses]

assembly_net = AssemblyNetwork.from_network_and_assembly_objects(line_net, as_objs)

if generate:
    assembly_net.save_to_stripstream_pkg(file_path, pkg_name, assembly_type, model_type, unit)

## inspect vertices in neighborhood
#v_id = 1
#v_nbhd = assembly_net.vertex_neighborhood(v_id)
#for v in v_nbhd:
#    as_o_nbgh = assembly_net.get_vertex_attribute(v, "assembly_object")
#    a.extend(draw_assembly_object_cmeshes(as_o_nbgh))
#    
#b = draw_assembly_object_cmeshes(assembly_net.get_vertex_attribute(v_id, "assembly_object"))
# ---------- end ghpython_script_6 ----------

data_dam = DataDam(DataDataA=curve_5, BufferDelay=10000000, BufferMode=0)
curve_6 = Curve(reparameterize(flatten(data_dam)))
end_points = EndPoints(Curve=curve_6)  # -> Start, End
merge_3 = Merge(Data1=end_points.Start, Data2=end_points.End)
remove_duplicate_points_karamba3d = RemoveDuplicatePointsKaramba3D(Point=merge_3, LimitDistance=0.005)  # -> OutPoint, Info, Indexes
curve_7 = Curve(curve_6)
point_19 = Point(remove_duplicate_points_karamba3d.OutPoint)
clean_tree = CleanTree(RemoveNulls=True, RemoveInvalid=True, RemoveEmpty=False, Tree=point_19)
c_script = CSharpScript(crvs=curve_7, pts=clean_tree, tol=0.001)  # -> out, nbgh_crvs, nbgh_point_to_pts, nbgh_crv_ids, e_node_list_ids; inputs crvs: list of Curve, pts: list of Point3d, tol: Double
# ---------- c_script: C# ----------
    DataTree<Line> line_tree = new DataTree<Line>();
    DataTree<Point3d> nbgh_pts = new DataTree<Point3d>();
    DataTree<int> nbgh_e_ids = new DataTree<int>();

    // index by edge id, record end vert ids
    DataTree<int> e_loc_tree = new DataTree<int>();

    // iterate over all the pts
    for(int v_id = 0; v_id < pts.Count; v_id++)
    {
      GH_Path pth = new GH_Path(v_id);
      Point3d p = pts[v_id];

      // iterate over all the lines
      for(int e_id = 0; e_id < crvs.Count; e_id++)
      {
        Curve crv = crvs[e_id];
        Point3d end_u = crv.PointAt(0);
        Point3d end_v = crv.PointAt(1);
        Point3d end_pt = p; // trivial init

        bool is_connected = false;

        if(end_u.DistanceTo(p) < tol)
        {
          end_pt = end_v;
          is_connected = true;
        }
        if(end_v.DistanceTo(p) < tol)
        {
          end_pt = end_u;
          is_connected = true;
        }

        // add pts in the neighbor
        if(is_connected)
        {
          // pth is indexed by vertex's id
          // add the pt to p(id: v_id)'s ngbh
          nbgh_pts.Add(end_pt, pth);
          nbgh_e_ids.Add(e_id, pth);

          // add this line to p's line nbgh
          line_tree.Add(new Line(p, end_pt), pth);

          GH_Path e_loc_pth;
          // if the edge has been created
          if(e_loc_tree.PathExists(new GH_Path(e_id, 0)))
          {
            e_loc_pth = new GH_Path(e_id, 1);
          }
          else
          {
            e_loc_pth = new GH_Path(e_id, 0);
          }

          // orig node id
          e_loc_tree.Add(v_id, e_loc_pth);

          // the current line's id in the orig node's nbgh list
          e_loc_tree.Add(line_tree.Branch(pth).Count - 1, e_loc_pth);
        }
      }
    }

    nbgh_crvs = line_tree;
    nbgh_point_to_pts = nbgh_pts;
    nbgh_crv_ids = nbgh_e_ids;
    e_node_list_ids = e_loc_tree;
# ---------- end c_script ----------
panel_9 = Panel(c_script.nbgh_crv_ids)
panel_10 = Panel("1.5")
construct_path_2 = ConstructPath(Indices=Slider(11, range=0..13))

# ----
# {element id; 0 / 1} - adjacent node ids
integer = Integer(c_script.e_node_list_ids)

# ----
# {node} - adjacent lines
curve_8 = Curve(c_script.nbgh_crvs)

clean_tree_2 = CleanTree(RemoveNulls=True, RemoveInvalid=True, RemoveEmpty=False, Tree=curve_7)

# ----
# lines in connectivity graph
curve_9 = Curve(clean_tree_2)

curve_10 = Curve(curve_9)

length_2 = Length(Curve=curve_8)
division_2 = Division(A=length_2, B="2")
negative_4 = Negative(Value=division_2)
list_item_9 = ListItem(List=integer, Index=0, Wrap=False)  # -> Item, Item1
extend_curve = ExtendCurve(Curve=curve_8, Type=0, Start=0, End=negative_4)
panel_11 = Panel(list_item_9.Item)
integer_2 = Integer(list_item_9.Item)
curve_11 = Curve(extend_curve)
curve_12 = Curve(curve_8)

c_script_2 = CSharpScript(data=curve_11, path=integer_2)  # -> out, A; inputs data: tree, path: tree of Int32
# ---------- c_script_2: C# ----------
    IList<GH_Path> path_data_pths = path.Paths;
    DataTree<object> fetched_tree = new DataTree<object>();

    foreach(GH_Path p_pth in path_data_pths)
    {
      GH_Path d_pth = new GH_Path(path.Branch(p_pth)[0]);

      foreach(Curve d in data.Branch(d_pth))
      {
        fetched_tree.Add(d, p_pth);
      }
    }

    A = fetched_tree;
# ---------- end c_script_2 ----------
list_item_10 = ListItem(List=c_script_2.A, Index=list_item_9.Item1, Wrap=True)

# ----
# {node} - adjacent lines
curve_13 = Curve(curve_12)

tree_branch = TreeBranch(Tree=curve_13, Path=construct_path_2, MaintainPaths=True)
panel_12 = Panel(list_item_10)
