# Grasshopper definition toggle_cage_urdf_export_v0.ghx (Grasshopper 1.0.7)
# plug-ins: Karamba

# ----
# rebars
brep = Brep([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])

# ----
# cages
brep_2 = Brep([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])

merge = Merge(Data1=brep_2, Data2=brep)
ghpython_script = GhPythonScript(shapes=merge)  # -> out, shape_verts, connect_edges; inputs shapes: list of Brep
# ---------- ghpython_script: Python ----------
__author__ = "yijiangh"
__version__ = "2019.03.07"

import rhinoscriptsyntax as rs
import ghpythonlib.components as ghcomp
from Rhino.Geometry import Point3d, Line
# https://developer.rhino3d.com/guides/rhinopython/ghpython-question-answer/

shape_verts = []
for i, b in enumerate(shapes):
    bbox,_ = ghcomp.BoundingBox(b)
    _, c_pt = ghcomp.Volume(bbox)
    shape_verts.append(c_pt)

connect_edges = []
for i, b in enumerate(shapes):
    for j, b_check in enumerate(shapes):
        if b == b_check:
            continue
        x_crv, x_pt = ghcomp.BrepXBrep(b, b_check)
        if x_crv or x_pt:
            connect_edges.append(Line(shape_verts[i], shape_verts[j]))
# ---------- end ghpython_script ----------

# ----
# connectivity graph
curve = Curve(ghpython_script.connect_edges)

# ----
# shape_vert (corresponding to shape ids)
point = Point(ghpython_script.shape_verts)

# ----
# start pt of rack plane
construct_point = ConstructPoint(XCoordinate=Slider(189, range=0..200), YCoordinate=0, ZCoordinate=Slider(137, range=0..350))
point_2 = Point(Point(789.7643421, 2538.513139, 704.6500366))
move = Move(Geometry=point_2, Motion=construct_point)  # -> Geometry, Transform

brep_3 = Brep(merge)
fixture_spacing = Panel("100")

# ----
# a target fixture pair
brep_4 = Brep([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])
brep_5 = Brep([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])

# ----
# rebar pick fixtures
brep_6 = Brep([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])

# ----
# rightmost line
curve_2 = Curve(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)

group = Group(Objects=brep_4)
group_2 = Group(Objects=brep_5)

# ----
# cage pick fictures
brep_7 = Brep([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])

brep_8 = Brep(brep_3)
volume = Volume(Geometry=brep_8)  # -> Volume, Centroid
series = Series(Start=0, Step=fixture_spacing, Count=Slider(10, range=0..10))
bounding_box = BoundingBox(Content=group_2, Plane=PlaneXY(0, 0, 0), UnionBox=True)  # -> Box, Box_2
bounding_box_2 = BoundingBox(Content=group, Plane=PlaneXY(0, 0, 0), UnionBox=True)  # -> Box, Box_2

# ----
# sort cages by x coords
deconstruct = Deconstruct(Point=volume.Centroid)  # -> XComponent, YComponent, ZComponent
sort_list = SortList(Keys=deconstruct.XComponent, ValuesValuesA=volume.Centroid)  # -> Keys, ValuesValuesA
sort_list_2 = SortList(Keys=deconstruct.XComponent, ValuesValuesA=brep_8)  # -> Keys, ValuesValuesA
brep_9 = Brep(sort_list_2.ValuesValuesA)
point_3 = Point(sort_list.ValuesValuesA)
list_item = ListItem(List=point_3, Index=0, Wrap=True)

unit_x = UnitX(Factor=series)
volume_2 = Volume(Geometry=bounding_box.Box)  # -> Volume, Centroid
volume_3 = Volume(Geometry=bounding_box_2.Box)  # -> Volume, Centroid
negative = Negative(Value=unit_x)
deconstruct_2 = Deconstruct(Point=volume_2.Centroid)  # -> XComponent, YComponent, ZComponent
deconstruct_3 = Deconstruct(Point=volume_3.Centroid)  # -> XComponent, YComponent, ZComponent
move_2 = Move(Geometry=curve_2, Motion=negative)  # -> Geometry, Transform
curve_3 = Curve(reparameterize(move_2.Geometry))
point_4 = Point(volume_3.Centroid)
unit_x_2 = UnitX(Factor=1)
point_5 = Point(volume_2.Centroid)
evaluate_curve = EvaluateCurve(Curve=curve_3, Parameter="0.5")  # -> Point, Tangent, Angle
xy_plane = XYPlane(Origin=Point(0, 0, 0))
vector_2pt = Vector2Pt(PointA=list_item, PointB=move.Geometry, Unitize=False)  # -> Vector, Length
point_6 = Point(volume.Centroid)
unit_y = UnitY(Factor=1)
rotate_3d = Rotate3D(Geometry=xy_plane, Angle=degrees(Slider(45, range=0..100)), Center=xy_plane, Axis=unit_x_2)  # -> Geometry, Transform
move_3 = Move(Geometry=volume.Centroid, Motion=vector_2pt.Vector)  # -> Geometry, Transform
point_7 = Point(reverse(evaluate_curve.Point))
negative_2 = Negative(Value=unit_y)
vector_2pt_2 = Vector2Pt(PointA=point_6, PointB=move_3.Geometry, Unitize=False)  # -> Vector, Length
brep_10 = Brep(brep_9)

# ----
# square cages indices
number_slider = Slider(4, range=0..10)
number_slider_2 = Slider(9, range=0..100)
addition = Addition(A=number_slider, B=1)
subtraction = Subtraction(A=Slider(13, range=0..13), B=number_slider_2)
addition_2 = Addition(A=subtraction, B=1)
series_2 = Series(Start=Slider(0, range=0..100), Step=1, Count=addition)
series_3 = Series(Start=number_slider_2, Step=1, Count=addition_2)
merge_2 = Merge(Data1=series_2, Data2=series_3)  # -> simplify(graft(Result))

construct_plane = ConstructPlane(Origin=point_7, XAxis=Vector(1, 0, 0), YAxis=negative_2)  # -> graft(Plane)
move_4 = Move(Geometry=brep_10, Motion=vector_2pt_2.Vector)  # -> Geometry, Transform

# ----
# connectivity graph
curve_4 = Curve(curve)
move_5 = Move(Geometry=curve_4, Motion=vector_2pt_2.Vector)  # -> Geometry, Transform

# ----
# cages in place
brep_11 = Brep(move_4.Geometry)

construct_path = ConstructPath(Indices=merge_2)
brep_12 = Brep(simplify(graft(brep_11)))
split_tree = SplitTree(Data=brep_12, Masks=flatten(construct_path))  # -> Positive, Negative
brep_13 = Brep(split_tree.Negative)
brep_14 = Brep(split_tree.Positive)

# ----
# square cages in place poses
brep_15 = Brep(brep_14)

bounding_box_3 = BoundingBox(Content=brep_15, Plane=rotate_3d.Geometry)  # -> Box, Box_2
deconstruct_brep = DeconstructBrep(Brep=bounding_box_3.Box)  # -> simplify(Faces), Edges, Vertices
list_item_2 = ListItem(List=deconstruct_brep.Faces, Index=Slider(0, range=0..11), Wrap=True)
deconstruct_plane = DeconstructPlane(Plane=list_item_2)  # -> Origin, XAxis, YAxis, ZAxis
volume_4 = Volume(Geometry=brep_14)  # -> Volume, Centroid
area = Area(Geometry=list_item_2)  # -> Area, Centroid
multiplication = Multiplication(A=deconstruct_plane.ZAxis, B=10)
deconstruct_4 = Deconstruct(Point=volume_4.Centroid)  # -> XComponent, YComponent, ZComponent
number = Number(deconstruct_4.XComponent)
construct_point_2 = ConstructPoint(XCoordinate=number, YCoordinate=deconstruct_3.YComponent, ZCoordinate=deconstruct_3.ZComponent)
construct_point_3 = ConstructPoint(XCoordinate=number, YCoordinate=deconstruct_2.YComponent, ZCoordinate=deconstruct_2.ZComponent)
vector_2pt_3 = Vector2Pt(PointA=point_4, PointB=construct_point_2, Unitize=False)  # -> Vector, Length
vector_2pt_4 = Vector2Pt(PointA=point_5, PointB=construct_point_3, Unitize=False)  # -> Vector, Length
move_6 = Move(Geometry=group, Motion=vector_2pt_3.Vector)  # -> Geometry, Transform
move_7 = Move(Geometry=group_2, Motion=vector_2pt_4.Vector)  # -> Geometry, Transform
point_8 = Point(area.Centroid)
vector_display = VectorDisplay(Anchor=point_8, Vector=multiplication)
plane_origin = PlaneOrigin(Base=list_item_2, Origin=point_8)
match_tree = MatchTree(Tree=construct_plane, Guide=plane_origin)

# ----
# square cages in place
brep_16 = Brep(brep_15)

brep_17 = Brep(brep_14)
orient = Orient(Geometry=brep_16, Source=plane_origin, Target=match_tree)  # -> Geometry, Transform
number_slider_3 = Slider(9, range=0..10)

# ----
# cages in pick
brep_18 = Brep(orient.Geometry)

# ----
# connectivity graph
curve_5 = Curve(move_5.Geometry)

list_item_3 = ListItem(List=flatten(brep_16), Index=number_slider_3, Wrap=True)
list_item_4 = ListItem(List=flatten(brep_18), Index=number_slider_3, Wrap=True)
data_dam = DataDam(DataDataA=curve_5, BufferDelay=10000000, BufferMode=0)
curve_6 = Curve(reparameterize(flatten(data_dam)))
end_points = EndPoints(Curve=curve_6)  # -> Start, End
merge_3 = Merge(Data1=end_points.Start, Data2=end_points.End)
remove_duplicate_points_karamba3d = RemoveDuplicatePointsKaramba3D(Point=merge_3, LimitDistance=0.005)  # -> OutPoint, Info, Indexes
curve_7 = Curve(curve_6)
point_9 = Point(remove_duplicate_points_karamba3d.OutPoint)
clean_tree = CleanTree(RemoveNulls=True, RemoveInvalid=True, RemoveEmpty=False, Tree=point_9)
c_script = CSharpScript(crvs=curve_7, pts=clean_tree, tol=0.001)  # -> out, nbgh_crvs, nbgh_point_to_pts, nbgh_crv_ids, e_node_list_ids; inputs crvs: list of Curve, pts: list of Point3d, tol: Double
# ---------- c_script: C# ----------
    DataTree<Line> line_tree = new DataTree<Line>();
    DataTree<Point3d> nbgh_pts = new DataTree<Point3d>();
    DataTree<int> nbgh_e_ids = new DataTree<int>();

    // index by edge id, record end vert ids
    DataTree<int> e_loc_tree = new DataTree<int>();

    // iterate over all the pts
    for(int v_id = 0; v_id < pts.Count; v_id++)
    {
      GH_Path pth = new GH_Path(v_id);
      Point3d p = pts[v_id];

      // iterate over all the lines
      for(int e_id = 0; e_id < crvs.Count; e_id++)
      {
        Curve crv = crvs[e_id];
        Point3d end_u = crv.PointAt(0);
        Point3d end_v = crv.PointAt(1);
        Point3d end_pt = p; // trivial init

        bool is_connected = false;

        if(end_u.DistanceTo(p) < tol)
        {
          end_pt = end_v;
          is_connected = true;
        }
        if(end_v.DistanceTo(p) < tol)
        {
          end_pt = end_u;
          is_connected = true;
        }

        // add pts in the neighbor
        if(is_connected)
        {
          // pth is indexed by vertex's id
          // add the pt to p(id: v_id)'s ngbh
          nbgh_pts.Add(end_pt, pth);
          nbgh_e_ids.Add(e_id, pth);

          // add this line to p's line nbgh
          line_tree.Add(new Line(p, end_pt), pth);

          GH_Path e_loc_pth;
          // if the edge has been created
          if(e_loc_tree.PathExists(new GH_Path(e_id, 0)))
          {
            e_loc_pth = new GH_Path(e_id, 1);
          }
          else
          {
            e_loc_pth = new GH_Path(e_id, 0);
          }

          // orig node id
          e_loc_tree.Add(v_id, e_loc_pth);

          // the current line's id in the orig node's nbgh list
          e_loc_tree.Add(line_tree.Branch(pth).Count - 1, e_loc_pth);
        }
      }
    }

    nbgh_crvs = line_tree;
    nbgh_point_to_pts = nbgh_pts;
    nbgh_crv_ids = nbgh_e_ids;
    e_node_list_ids = e_loc_tree;
# ---------- end c_script ----------
panel = Panel(c_script.nbgh_crv_ids)

# ----
# {element id; 0 / 1} - adjacent node ids
integer = Integer(c_script.e_node_list_ids)

# ----
# {node} - adjacent lines
curve_8 = Curve(c_script.nbgh_crvs)

length = Length(Curve=curve_8)
panel_2 = Panel("1.5")
division = Division(A=length, B="2")
negative_3 = Negative(Value=division)
list_item_5 = ListItem(List=integer, Index=0, Wrap=False)  # -> Item, Item1
extend_curve = ExtendCurve(Curve=curve_8, Type=0, Start=0, End=negative_3)
panel_3 = Panel(list_item_5.Item)
integer_2 = Integer(list_item_5.Item)
curve_9 = Curve(extend_curve)
curve_10 = Curve(curve_8)

c_script_2 = CSharpScript(data=curve_9, path=integer_2)  # -> out, A; inputs data: tree, path: tree of Int32
# ---------- c_script_2: C# ----------
    IList<GH_Path> path_data_pths = path.Paths;
    DataTree<object> fetched_tree = new DataTree<object>();

    foreach(GH_Path p_pth in path_data_pths)
    {
      GH_Path d_pth = new GH_Path(path.Branch(p_pth)[0]);

      foreach(Curve d in data.Branch(d_pth))
      {
        fetched_tree.Add(d, p_pth);
      }
    }

    A = fetched_tree;
# ---------- end c_script_2 ----------
list_item_6 = ListItem(List=c_script_2.A, Index=list_item_5.Item1, Wrap=True)

panel_4 = Panel(list_item_6)
brep_19 = Brep(brep_11)
construct_path_2 = ConstructPath(Indices=Slider(11, range=0..13))

# ----
# verts in connectivity graph
point_10 = Point(clean_tree)

# ----
# lines in connectivity graph
curve_11 = Curve(curve_7)

# ----
# {node} - adjacent lines
curve_12 = Curve(curve_10)

brep_20 = Brep(brep_19)
tree_branch = TreeBranch(Tree=curve_12, Path=construct_path_2, MaintainPaths=True)
curve_13 = Curve(curve_11)
brep_21 = Brep(brep_20)

number_slider_4 = Slider(90, range=0..90)  # disabled
panel_5 = Panel("360")  # disabled
number_slider_5 = Slider(0.7, range=0..1)  # disabled
number_slider_6 = Slider(8, range=0..147)  # disabled
curve_14 = Curve(curve_12)  # disabled
division_2 = Division(A=number_slider_4, B=panel_5)  # disabled
pi = Pi(Factor=division_2)  # disabled
division_3 = Division(A=panel_5, B=number_slider_4)  # disabled
perp_frame = PerpFrame(Curve=reparameterize(curve_14), Parameter=number_slider_5)  # disabled
construct_path_3 = ConstructPath(Indices=number_slider_6)  # disabled
series_4 = Series(Start=0, Step=number_slider_4, Count=division_3)  # disabled
brep_22 = Brep(brep_21)  # disabled
rotate_plane = RotatePlane(Plane=simplify(graft(perp_frame)), Angle=degrees(series_4))  # disabled
concatenate = Concatenate(A="{", Fragment_A=number_slider_6, Fragment_B=";*}")  # disabled
split_tree_2 = SplitTree(Data=rotate_plane, Masks=flatten(concatenate))  # -> Positive, Negative; disabled
plane = Plane(rotate_plane)  # disabled
shift_paths = ShiftPaths(Data=plane, Offset=-1)  # disabled
tree_branch_2 = TreeBranch(Tree=brep_22, Path=construct_path_3, MaintainPaths=True)  # disabled
tree_branch_3 = TreeBranch(Tree=shift_paths, Path=construct_path_3, MaintainPaths=True)  # disabled
tree_branch_4 = TreeBranch(Tree=curve_14, Path=construct_path_3, MaintainPaths=True)  # disabled

point_11 = Point(point_10)
group_3 = Group(Objects=brep_21)
data = Data(group_3)
ungroup = Ungroup(Group=data)  # -> simplify(Objects)
ghpython_script_2 = GhPythonScript()  # -> out, sub_graph_lines; inputs sub_graph_vertices: list of Point3d, full_graph_lines: list of Curve; disabled
# ---------- ghpython_script_2: Python ----------
import ghpythonlib.components as ghcomp

from compas.datastructures import Network
from compas.geometry import Point, Line
from compas.geometry import distance_point_point
from compas_ghpython import xdraw_lines
from timber_workshop_robarch.utilities import *

###########################
def subgraph_from_vertices(net, vert_ids):
    """
    Simply sweep over the edge set.
    
    Parameters
    ----------
    net: compas.ds.Network
    vert_ids: a list of vert ids
    
    Returns
    -------
    """
    edge_list = []
    for e in net.edges():
        u, v = e
        if (u in vert_ids) and (v in vert_ids):
            edge_list.append((u,v))
        
#    vert_list = [net.vertex_coordinates(id) for id in vert_ids]
    
    return Network.from_vertices_and_edges(net.to_points(), edge_list)

###########################

input_lines = []
for crv in full_graph_lines:
    end_pt_1, end_pt_2 = ghcomp.EndPoints(crv)
    # convert rhino pt to compas pt
    input_lines.append([rPt2cPt(end_pt_1), rPt2cPt(end_pt_2)])
    
sub_vert = [rPt2cPt(p) for p in sub_graph_vertices]
net = Network.from_lines(input_lines)

sub_vert_ids = []
for i in range(net.number_of_vertices()):
    for t in sub_graph_vertices:
        if distance_point_point(net.vertex_coordinates(i), t) < 1e-3:
            sub_vert_ids.append(i)

sub_net = subgraph_from_vertices(net, sub_vert_ids)
#print(sub_net.to_points())
sub_graph_lines = get_network_rhino_axes(sub_net)

#xdraw_lines(sub_graph_lines)
#sub_graph = Network.from_vertices_and_edges(sub_vert, sub_vert_ids)
# ---------- end ghpython_script_2 ----------

bounding_box_4 = BoundingBox(Content=ungroup, Plane=PlaneXY(0, 0, 0), UnionBox=True)  # -> Box, Box_2
deconstruct_brep_2 = DeconstructBrep(Brep=bounding_box_4.Box)  # -> Faces, Edges, simplify(Vertices)
average = Average(Input=deconstruct_brep_2.Vertices)
point_12 = Point(average)
xy_plane_2 = XYPlane(Origin=point_12)  # -> flatten(Plane)

construct_point_4 = ConstructPoint(XCoordinate=Slider(436, range=0..700), YCoordinate=Slider(-286, range=-700..700), ZCoordinate=Slider(0, range=0..700))
plane_origin_2 = PlaneOrigin(Base=xy_plane_2, Origin=construct_point_4)

mesh_brep = MeshBrep(
    Brep=ungroup,
    Settings={GridMaxCount=0, GridMinCount=16, JaggedSeams=False, MaxEdgeLength=0, MinEdgeLength=0.0001, MinTolerance=0, Refine=True, RefineAngle=0, RelativeTolerance=0.65, SimplePlanes=True, Tolerance=0})

# ----
# network verts and edges
point_13 = Point(point_11)
curve_15 = Curve(curve_13)

# ----
# base frame
xy_plane_3 = XYPlane(Origin=Point(0, 0, 0))

# ----
# shape meshes
# (aligned w/ verts)
mesh = Mesh(mesh_brep)

# ----
# world from grasp poses
plane_2 = Plane(shift_paths)

panel_6 = Panel("D:\Dropbox (MIT)\Projects\Choreo\Software\picknplace\urdf_exporter\objs\")
py_bake = PythonScript(active=Button(), path_out=panel_6, file_prefix="TestExport", file_suffix=".obj")  # -> out, object_guid; inputs geo: list
# ---------- py_bake: Python ----------
import os
import rhinoscriptsyntax as rs
import scriptcontext
import Rhino

#----------------functions----------------
def ExportAsObj(id, obj, filePath, file_prefix, file_suffix):
    #filepath = "C:\Test\TestExport.obj"
    if not os.path.isdir(filePath):
        os.mkdir(filePath)
    fileFullPath = filePath + file_prefix + '_' + str(id) + file_suffix
    
    write_options = Rhino.FileIO.FileWriteOptions()
    write_options.WriteSelectedObjectsOnly = True
    
    # select the object
    obj.Select(True)
    
    obj_options = Rhino.FileIO.FileObjWriteOptions(write_options)
    obj_options.UseSimpleDialog = True
    obj_options.CreateNgons = False
    obj_options.MapZtoY = False
    obj_options.ExportNormals = True
    obj_options.ExportMaterialDefinitions = False
    
    # texture stuff
    obj_options.ExportTcs = False
    obj_options.ExportVcs = False
    
    #obj_options.ObjGroupNames = 1

    rc = Rhino.FileIO.FileObj.Write(fileFullPath, Rhino.RhinoDoc.ActiveDoc, obj_options)
    if rc == Rhino.PlugIns.WriteFileResult.Success:
        print "Success, file saved:", fileFullPath
    else:
        print "Error saving file:", fileFullPath
    
    # de-select the object
    obj.Select(False)
##########################################

if active:
    for i, geo in enumerate(geo): 
        #we create or use some geometry
        geo_id = geo # or rs.AddLine((0,1,2), (9,8,7))
        
        #(we could do all operations here...
        
        scriptcontext.doc = ghdoc
        #we obtain the reference in the Rhino doc
        doc_object = rs.coercerhinoobject(geo_id)
        print('the type of odc_object is: ' + str(type(doc_object)))
        
        attributes = doc_object.Attributes
        print('the type of attributes is: ' + str(type(attributes)))
        geometry = doc_object.Geometry
        print('the type of geometry is: ' + str(type(geometry)))
        
        #we change the scriptcontext
        scriptcontext.doc = Rhino.RhinoDoc.ActiveDoc
        
        #we add both the geometry and the attributes to the Rhino doc
        rhino_geo_id = scriptcontext.doc.Objects.Add(geometry, attributes)
        rhino_geo = scriptcontext.doc.Objects.Find(rhino_geo_id)
        print('the Rhino doc ID is: ' + str(rhino_geo_id))
        
#        if export:
        ExportAsObj(i, rhino_geo, path_out, file_prefix, file_suffix)

#we put back the original Grasshopper document as default
scriptcontext.doc = ghdoc
# ---------- end py_bake ----------
panel_7 = Panel(py_bake.out)

panel_8 = Panel("E:\Dropbox (MIT)\Projects\Choreo\Software\picknplace\urdf_exporter")

# ----
# the centroid of the assembled
# cages (for now)
plane_3 = Plane(xy_plane_2)

generate_pkg = Button()
# Note:
# Not sure which one is better:
# 1. ee_pose from scene
# 2. ee_pose from object pose
panel_9 = Panel("millimeter")
plane_4 = Plane(plane_origin_2)
ghpython_script_3 = GhPythonScript(
    network_lines=curve_15,
    network_vertices=point_13,
    assembly_objects=mesh,
    world_from_place_poses=plane_3,
    world_from_pick_poses=plane_4,
    world_from_grasp_poses=plane_2,
    base_frame=xy_plane_3,
    file_path=panel_8,
    pkg_name="toggle_rebar_cage_1",
    assembly_type="picknplace",
    model_type="3D_discrete_objs",
    unit=panel_9,
    generate=generate_pkg)  # -> out, simplify(a), b, c; inputs network_lines: list of Curve, network_vertices: list of Point3d, assembly_objects: tree of Mesh, world_from_place_poses: list of Plane, world_from_pick_poses: list of Plane, world_from_grasp_poses: tree of Plane, base_frame: Plane, generate: Boolean; disabled
# ---------- ghpython_script_3: Python ----------
"""Creates an AssemblyNetwork and creates a problem instance pkg for stripstream
    
    Inputs
    ------
    network_lines: a list of rg.Curve
    network_vertices: a list of rg.Point3d
        this list must be indexed correponding to the tree branch in
        assembly objects
    assembly_objects: a DataTree of rg.Mesh
    
    assembly_object_poses:
        
    world_from_grasp_pose
    Outputs
    -------
        a: The a output variable"""

__author__ = "yijiangh"
__version__ = "2019.01.26"

import sys
import copy
import os
import json
from collections import OrderedDict

import Rhino.Geometry as rg
import ghpythonlib.components as ghcomp
import ghpythonlib.treehelpers as th

from compas.datastructures import Mesh, Network
from compas.geometry import Frame, Point
from compas.geometry import Transformation, transform_points, cross_vectors
from compas_ghpython import xdraw_mesh, xdraw_frame

# some useful rg<->compas conversion util fns
from timber_workshop_robarch.utilities import *

##########################################
def tree_to_lists(input):
    """converts a depth-2 GH datatree to a list of lists
    """
    all = []
    for path in input.Paths:
        branch_list = []
        for obj in input.Branch(path):
            branch_list.append(obj)
        all.append(branch_list)
    return all

def rPln2cFrame(rplane):
    """converts a rhino plane to compas frame
    """
    return Frame(rplane.Origin, rplane.XAxis, rplane.YAxis)

def transform_cmesh(cmesh, ctf):
    """transform a compas mesh
    Paramters
    ---------
    cmesh: a compas mesh
    ctf: a compas transformation
    """
    verts, faces = cmesh.to_vertices_and_faces()
    for i, v in enumerate(verts):
        v_tf = transform_points([v], ctf)[0]
        cmesh.set_vertex_attributes(i, ['x','y','z'], v_tf)
    return cmesh

def network_from_rg_pts_and_lines(vertices, lines, tol=1e-3):
    """create a compas network using given rhino pts and lines
    
    Paramters
    ---------
    vertices: list of rh.point3d
    edges: list of rh.curve
    
    Returns
    -------
    """
    net_lines = []
    for crv in lines:
        rg_end_pt_1, rg_end_pt_2 = ghcomp.EndPoints(crv)
        end_1_id = -1
        end_2_id = -1
        
        # convert rhino pt to compas pt
        for v_id, v in enumerate(vertices):
            if rg_end_pt_1.DistanceTo(v) < tol:
                end_1_id = v_id
            if rg_end_pt_2.DistanceTo(v) < tol:
                end_2_id = v_id
        
        assert((end_1_id != -1) \
        and (end_2_id != -1) \
        and (end_1_id != end_2_id))
        
        net_lines.append((end_1_id, end_2_id))
    
    cp_verts = [rPt2cPt(rpt) for rpt in vertices]
    return Network.from_vertices_and_edges(cp_verts, net_lines)
    
def draw_assembly_object_cmeshes(as_o, stage="place"):
    """
    Parameters:
        as_o: AssemblyObject
        stage: flag for 'place', 'pick'
    """
    if stage == "place":
        return [xdraw_mesh(*cm.to_vertices_and_faces()) for cm in as_o.shape_in_place_pose]
    elif "pick":
        return [xdraw_mesh(*cm.to_vertices_and_faces()) for cm in as_o.shape_in_pick_pose]
    else:
        return None

# -----------------
# json export utils
# -----------------
def obj_name(obj_id, sub_id):
    name = "object_" + str(obj_id) + "-" + str(sub_id) + ".obj"
    return name

def cframe2json(cfr):
    """
    Parameters
    ----------
    cfr: compas frame
    """
    dict = OrderedDict()
    dict["XAxis"] = cfr.to_data()["xaxis"]
    dict["YAxis"] = cfr.to_data()["yaxis"]
    dict["ZAxis"] = cross_vectors(dict["XAxis"], dict["YAxis"])
    dict["Origin"] = cfr.to_data()["point"]
    return dict

##########################################
WORLD_FRAME = Frame.worldXY()

class AssemblyObject(object):
    """assembly object that embodies geometry, geometry pose, grasp pose
    
    Attributes
    ----------
    base_frame: compas.geometry.Frame
        The frame that the data is associated with/described in.
        Defaults to be the 'base_link' (world xyz).
    id: string
        The id of the object, usually an int index of the object
    shape: compas.geometry.Mesh
        The assembly object's geometry, the mesh vertices coordinates are
        associated to the 'base_link' (world xyz)
    shape_pick_pose: compas.geometry.Frame
        The shape's pose to be picked described in the associated base_frame
    shape_place_pose: compas.geometry.Frame 
        The shape's pose to be placed described in the associated base_frame
    shape_time_stamped_pose: dict{float : compas.geometry.Frame}
        current shape pose
    object_from_ee_poses: list of compas.geometry.Frame
        The end effector (ee/gripper) grasp poses described in the object's 
        shape_pose frame.
    """
    
    def __init__(self, base_frame=WORLD_FRAME, id=-1, \
        shape=None, shape_place_pose=None):
        """
        
        Parameters
        ----------
            base_frame: compas.geometry.Frame
                Defaults to the world xyz
            id: int
                Defaults to be -1
            shape: compas.geometry.Mesh
                Defaults to be None
        """
        self.base_frame = base_frame
        self.id = id
        self.shape = shape
        self.shape_place_pose = None
        self.shape_pick_pose = None
        
    # --------------
    # constructors
    # --------------
    @classmethod
    def create_from_object_place_pose(cls, id, rbase_frame, \
            rgeometry_in_scene, rpose_in_scene):
        """create object from geometry in a scene pose
        
        We perform transformation here to orient the geometry back to
        the base_link
        
        Parameters
        ----------
        rbase_frame : rhion plane
        rgeometry_in_scene: list of rhino meshes
        rpose_in_scene: rhino planes
        """
        as_obj = cls()
        as_obj.base_frame = rPln2cFrame(rbase_frame)
        as_obj.shape_place_pose = rPln2cFrame(rpose_in_scene)
        
        # perform transformation on the geometry_in_scene
        obj_tf = Transformation.from_frame(as_obj.shape_place_pose)
        
        cmesh_tf = [transform_cmesh(rMesh2cMesh(rm), obj_tf.inverse()) \
                for rm in rgeometry_in_scene]
        
        as_obj.shape = cmesh_tf
        
        return as_obj
        
    # --------------
    # attributes assigners
    # --------------
    def set_pick_in_scene_pose(self, rpick_plane):
        self.shape_pick_pose = rPln2cFrame(rpick_plane)
        
    def set_place_in_scene_pose(self, rplace_plane):
        self.shape_place_pose = rPln2cFrame(rplace_plane)
        
    def set_ee_poses_from_in_scene_poses(self, rworld_from_obj_pose, rworld_from_ee_poses):
        """create obj_from_grasp poses from world
        
        Parameters
        ----------
        rworld_from_obj_pose: rhino plane
        rworld_from_ee_poses: a list of rhino plane
        """
        world_obj_tf = Transformation.from_frame( \
            rPln2cFrame(rworld_from_obj_pose))
        
        self.object_from_ee_poses = []
        for world_ee_fr in [rPln2cFrame(rw_ee) for rw_ee in rworld_from_ee_poses]:
            w_ee_tf = Transformation.from_frame(world_ee_fr)
            self.object_from_ee_poses.append(Frame.from_transformation( \
                Transformation.concatenate(world_obj_tf.inverse(), w_ee_tf)))
                
        
    def set_ee_place_poses_from_obj(self, obj_from_ee_poses):
        assert(False, "not implemented")
    
    @property
    def world_from_pick_ee_poses(self):
        """return a list of (world_from) ee pick poses
        """
        assert(self.shape_pick_pose != None, "pick pose not defined!")
        world_from_ee_pick = []
        world_pick_tf = Transformation.from_frame(self.shape_pick_pose)
        for obj_from_ee in self.object_from_ee_poses:
            w_f_ee_tf = Transformation.concatenate(world_pick_tf, Transformation.from_frame(obj_from_ee))
            world_from_ee_pick.append(Frame.from_transformation(w_f_ee_tf))
        return world_from_ee_pick
    
    @property
    def world_from_place_ee_poses(self):
        """return a list of (world_from) ee place poses
        """
        assert(self.shape_place_pose != None, "place pose not defined!")
        world_from_ee_place = []
        world_place_tf = Transformation.from_frame(self.shape_place_pose)
        for obj_from_ee in self.object_from_ee_poses:
            w_f_ee_tf = Transformation.concatenate(world_place_tf, Transformation.from_frame(obj_from_ee))
            world_from_ee_place.append(Frame.from_transformation(w_f_ee_tf))
        return world_from_ee_place
        
    @property
    def shape_in_pick_pose(self):
        """return shape geometries in pick pose"""
        assert(self.shape_pick_pose != None, "pick pose not defined!")
        world_pick_tf = Transformation.from_frame(self.shape_pick_pose)
        return [transform_cmesh(cm, world_pick_tf) for cm in self.shape]
#        return [cm for cm in self.shape]
    
    @property
    def shape_in_place_pose(self):
        """return shape geometries in pick pose"""
        assert(self.shape_place_pose != None, "place pose not defined!")
        world_place_tf = Transformation.from_frame(self.shape_place_pose)
        return [transform_cmesh(cm, world_place_tf) for cm in self.shape]
        
class AssemblyNetwork(Network):
    """
    
    Attributes
    ----------
        
    """
    def __init__(self):
        super(AssemblyNetwork, self).__init__()
    
    # --------------
    # constructors
    # --------------
    @classmethod
    def from_network(cls, net):
        as_net = cls()
        as_net.vertex = net.vertex 
        as_net.edge = net.edge
        as_net.halfedge = net.halfedge
        as_net.attributes = net.attributes
        return as_net
        
    @classmethod
    def from_network_and_assembly_objects(cls, net, objs):
        assert(net.number_of_vertices()==len(objs), \
            "assembly objects and network vertices not aligned!")
        as_net = cls.from_network(net)
        
        # assign assembly object attribute
        for i, vert_key in enumerate(as_net.vertices()):
            objs[i].id = i
            as_net.set_vertex_attribute(vert_key, "assembly_object", objs[i])
        return as_net
    
    # --------------
    # properties getters
    # --------------
    @property
    def assembly_objects(self):
        return [self.get_vertex_attribute(v, "assembly_object") \
            for v in self.vertices()]
    
    def assembly_object(self, vert_id):
        return self.assembly_objects[vert_id]
        
    # --------------
    # exporters
    # --------------
    def save_assembly_object_to_objs(self, mesh_path):
        if not os.path.isdir(mesh_path):
            os.mkdir(mesh_path)
            
        for as_obj in self.assembly_objects:
            for i, s in enumerate(as_obj.shape):
                s.to_obj(os.path.join(mesh_path, obj_name(as_obj.id, i)))
        
    def save_assembly_network_to_json(self, json_path, pkg_name='', \
            assembly_type='', model_type='', unit=''):
        if not os.path.isdir(json_path):
            os.mkdir(json_path)
        
        json_file_path = os.path.join(json_path, pkg_name + '.json')
        
        data = OrderedDict()
        data['pkg_name'] = pkg_name
        data['assembly_type'] = assembly_type
        data['model_type'] = model_type
        data['unit'] = unit
        
        data['element_number'] = self.number_of_vertices()
        data['sequenced_elements'] = []
        
        for v in self.vertices():
            assert(v == self.assembly_object(v).id)
            ao = self.assembly_object(v)
            
            e_data = OrderedDict()
            e_data['order_id'] = v
            e_data['base_frame'] = cframe2json(ao.base_frame)
            e_data['element_geometry_file_names'] = [obj_name(v, sub_id) \
                for sub_id in range(len(ao.shape))]
            
            grasp_data = OrderedDict()
            grasp_data['parent_link'] = 'object' #world
            grasp_data['ee_poses'] = [cframe2json(ee_p) \
                for ee_p in ao.object_from_ee_poses]
            
            pick = OrderedDict()
            pick['process_name'] = 'pick'
            pick['base_frame'] = cframe2json(ao.base_frame)
            pick['target_pose'] = cframe2json(ao.shape_pick_pose)
            pick['allowed_collision_obj_names'] = [] # support tables
            
            place = OrderedDict()
            place['process_name'] = 'place'
            place['base_frame'] = cframe2json(ao.base_frame)
            place['target_pose'] = cframe2json(ao.shape_place_pose)
            place['allowed_collision_obj_names'] = [] # support tables
            for nghb_id in self.vertex_neighborhood(v):
                place['allowed_collision_obj_names'].extend(
                    [obj_name(nghb_id, sub_id) \
                        for sub_id in range(len(self.assembly_object(nghb_id).shape))])
            
            grasp_data['processes'] = [pick, place]
            e_data['grasps'] = grasp_data
            
            data['sequenced_elements'].append(e_data)
        
        with open(json_file_path, 'w') as outfile:  
            json.dump(data, outfile, indent=4)
            
    def save_assembly_network_to_urdf(self, urdf_path):
        pass
        
    def save_to_stripstream_pkg(self, save_path, pkg_name, \
        assembly_type="", model_type="", unit=""):
        root_path = os.path.join(save_path, pkg_name)
        if not os.path.isdir(root_path):
            os.mkdir(root_path)
        
        json_path = os.path.join(root_path, "json")
        mesh_path = os.path.join(root_path, "meshes", "collision")
        urdf_path = os.path.join(root_path, "urdf")
        check_paths = [json_path, mesh_path, urdf_path]
        for p in check_paths:
            if not os.path.isdir(p):
                os.mkdir(p)
                
        # generate obj files
        self.save_assembly_object_to_objs(mesh_path)
        
        # generate json
        self.save_assembly_network_to_json(json_path, pkg_name, assembly_type, model_type, unit)
        
        # genereate urdf
#        self.save_assembly_network_to_urdf(urdf_path)

########################################
# main
a = []
b = []
c = []

# temp drawing
tf_meshes = []

line_net = network_from_rg_pts_and_lines(network_vertices, network_lines)
#a = get_network_rhino_axes(line_net)

# create assembly objects
obj_lists = tree_to_lists(assembly_objects)
grasp_pose_lists = tree_to_lists(world_from_grasp_poses)
as_objs = []

for i, obj_list in enumerate(obj_lists):
    as_obj = AssemblyObject.create_from_object_place_pose( \
        str(i), base_frame,
        obj_list, world_from_place_poses[i])
    as_obj.set_pick_in_scene_pose(world_from_pick_poses[i])
    as_obj.set_ee_poses_from_in_scene_poses(world_from_place_poses[i], grasp_pose_lists[i])
    
    as_objs.append(as_obj)

as_o = as_objs[0]
#print(as_o.shape_pick_pose.to_data())
#a = xdraw_frame(as_o.shape_pick_pose)
#b = [xdraw_mesh(*cm.to_vertices_and_faces()) for cm in as_o.shape_in_pick_pose]
#c = [xdraw_frame(ee) for ee in as_o.world_from_pick_ee_poses]

assembly_net = AssemblyNetwork.from_network_and_assembly_objects(line_net, as_objs)

if generate:
    assembly_net.save_to_stripstream_pkg(file_path, pkg_name, assembly_type, model_type, unit)

## inspect vertices in neighborhood
#v_id = 1
#v_nbhd = assembly_net.vertex_neighborhood(v_id)
#for v in v_nbhd:
#    as_o_nbgh = assembly_net.get_vertex_attribute(v, "assembly_object")
#    a.extend(draw_assembly_object_cmeshes(as_o_nbgh))
#    
#b = draw_assembly_object_cmeshes(assembly_net.get_vertex_attribute(v_id, "assembly_object"))
# ---------- end ghpython_script_3 ----------
ghpython_script_4 = GhPythonScript()  # -> out, a
# ---------- ghpython_script_4: Python ----------
## Frame example
from compas.geometry import Frame
from compas_ghpython import xdraw_frame
from compas.geometry.xforms import Transformation
from compas.geometry import transform_points
from compas_ghpython import xdraw_points

point = (0.0, 0.0, 63.0)
xaxis = (1.0, 0.0, 0.0)
yaxis = (0.0, 1.0, 0.0)
F1 = Frame(point, xaxis, yaxis)
a = [xdraw_frame(F1)]
point = (146.00, 150.00, 161.50)
xaxis = (0.9767, 0.0010, -0.214)
yaxis = (0.1002, 0.8818, 0.4609)
F2 = Frame(point, xaxis, yaxis)
a.append(xdraw_frame(F2))

a = []
P1 = (35., 35., 35.)
a += xdraw_points([{'pos': P1}])
world = Frame.worldXY()
Tw = Transformation.from_frame_to_frame(world, F1)
Pw = transform_points([P1], Tw)
a += xdraw_points([{'pos': Pw[0]}])
T = Transformation.from_frame_to_frame(F1, F2)
P2 = transform_points(Pw, T)
a += xdraw_points([{'pos': P2[0]}])
# ---------- end ghpython_script_4 ----------
panel_10 = Panel(ghpython_script_4.a)
data_2 = Data(ghpython_script_3.a)
data_3 = Data(ghpython_script_3.b)
panel_11 = Panel(ghpython_script_3.out)
