# Grasshopper definition ur_picknplace_urdf_export_v0.ghx (Grasshopper 1.0.7)

# ----
# for ur3
brep = Brep(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)
brep_2 = Brep(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)
brep_3 = Brep(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)

# ----
# for ur3
brep_4 = Brep(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)
brep_5 = Brep(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)
brep_6 = Brep(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)

number_slider = Slider(255, range=0..1000)

# ----
# element
# in pick position
merge = Merge(Data1=brep, Data2=brep_3, Data3=brep_2)  # -> simplify(graft(Result))

# ----
# element
# in place position
merge_2 = Merge(Data1=brep_4, Data2=brep_6, Data3=brep_5)  # -> simplify(graft(Result))

colour_rgb = ColourRGB(Alpha=255, Red=number_slider, Green=0, Blue=0)
colour_rgb_2 = ColourRGB(Alpha=255, Red=0, Green=0, Blue=number_slider)
custom_preview = CustomPreview(Geometry=merge, Material=colour_rgb)
custom_preview_2 = CustomPreview(Geometry=merge_2, Material=colour_rgb_2)

# ----
# make element central frame
# (for the picked geometry)
cluster = Cluster(brep=merge)

# ----
# make element central frame
# (for the placed geometry)
cluster_2 = Cluster(brep=merge_2)

plane = Plane(cluster)
plane_2 = Plane(cluster_2)
deconstruct_plane = DeconstructPlane(Plane=plane_2)  # -> Origin, XAxis, YAxis, ZAxis
multiplication = Multiplication(A=Slider(2, range=0..3), B="0.5")
multiplication_2 = Multiplication(A=Slider(0, range=0..3), B="0.5")
pi = Pi(Factor=multiplication)
pi_2 = Pi(Factor=multiplication_2)
rotate_3d = Rotate3D(Geometry=plane_2, Angle=pi_2, Center=deconstruct_plane.Origin, Axis=deconstruct_plane.YAxis)  # -> Geometry, Transform
deconstruct_plane_2 = DeconstructPlane(Plane=rotate_3d.Geometry)  # -> Origin, XAxis, YAxis, ZAxis
rotate_3d_2 = Rotate3D(Geometry=rotate_3d.Geometry, Angle=pi, Center=deconstruct_plane_2.Origin, Axis=deconstruct_plane_2.ZAxis)  # -> Geometry, Transform
brep_7 = Brep(merge_2)
brep_8 = Brep(merge)

# ----
# element pose in pick
brep_9 = Brep(brep_8)
plane_3 = Plane(plane)

# ----
# element pose in place
plane_4 = Plane(rotate_3d_2.Geometry)
brep_10 = Brep(brep_7)

# ----
# element pose transform
# from pick to place
orient = Orient(Geometry=brep_9, Source=plane_3, Target=plane_4)  # -> Geometry, Transform

panel = Panel("""0
1
2
3""")

# ----
# contact faces id
number_slider_2 = Slider(1, range=0..5)
number_slider_3 = Slider(0, range=0..5)
deconstruct_brep = DeconstructBrep(Brep=brep_9)  # -> simplify(Faces), Edges, Vertices
list_item = ListItem(List=deconstruct_brep.Faces, Index=panel, Wrap=True)  # -> simplify(Item)

deconstruct_brep_2 = DeconstructBrep(Brep=list_item)  # -> simplify(Faces), simplify(Edges), Vertices
area = Area(Geometry=list_item)  # -> Area, Centroid
face_normals = FaceNormals(Mesh=list_item)  # -> Centers, simplify(Normals)
length = Length(Curve=deconstruct_brep_2.Edges)
vector = Vector(face_normals.Normals)
sort_list = SortList(Keys=length, ValuesValuesA=deconstruct_brep_2.Edges)  # -> Keys, ValuesValuesA
point = Point(simplify(graft(area.Centroid)))
list_item_2 = ListItem(List=vector, Index=0, Wrap=True)
list_item_3 = ListItem(List=sort_list.ValuesValuesA, Index=0, Wrap=True)  # -> Item1, Item
reverse = Reverse(Vector=list_item_2)
curve = Curve(list_item_3.Item1)

# ----
# z axis along the elemental longitude axis
# x axis the opposite of the contact face normal
end_points = EndPoints(Curve=curve)  # -> Start, End
vector_2pt = Vector2Pt(PointA=end_points.Start, PointB=end_points.End, Unitize=True)  # -> Vector, Length
cross_product = CrossProduct(VectorA=vector_2pt.Vector, VectorB=reverse, Unitize=False)  # -> Vector, Length
construct_plane = ConstructPlane(Origin=point, XAxis=reverse, YAxis=cross_product.Vector)

# ----
# range of the possible grasp line
number_slider_4 = Slider(27, range=0..100)

deconstruct_plane_3 = DeconstructPlane(Plane=construct_plane)  # -> Origin, XAxis, YAxis, ZAxis
negative = Negative(Value=number_slider_4)
multiplication_3 = Multiplication(A=number_slider_4, B=deconstruct_plane_3.ZAxis)
multiplication_4 = Multiplication(A=negative, B=deconstruct_plane_3.ZAxis)
move = Move(Geometry=deconstruct_plane_3.Origin, Motion=multiplication_4)  # -> Geometry, Transform
move_2 = Move(Geometry=deconstruct_plane_3.Origin, Motion=multiplication_3)  # -> Geometry, Transform

# ----
# discretizing length
number_slider_5 = Slider(17, range=0..100)

line = Line(StartPoint=move.Geometry, EndPoint=move_2.Geometry)
length_2 = Length(Curve=line)
division = Division(A=length_2, B=number_slider_5)
round = Round(Number=division)  # -> Nearest, Floor, Ceiling
divide_curve = DivideCurve(Curve=line, Count=round.Floor, Kinks=False)  # -> Points, Tangents, Parameters
point_2 = Point(simplify(graft(deconstruct_plane_3.Origin)))
plane_5 = Plane(simplify(graft(construct_plane)))
point_3 = Point(divide_curve.Points)
vector_2pt_2 = Vector2Pt(PointA=point_2, PointB=point_3, Unitize=False)  # -> Vector, Length
move_3 = Move(Geometry=plane_5, Motion=vector_2pt_2.Vector)  # -> Geometry, Transform

# ----
# forward / reverse grasps
plane_6 = Plane(simplify(graft(move_3.Geometry)))
deconstruct_plane_4 = DeconstructPlane(Plane=plane_6)  # -> Origin, XAxis, YAxis, ZAxis
panel_2 = Panel("""0
180""")
rotate_3d_3 = Rotate3D(Geometry=plane_6, Angle=degrees(panel_2), Center=deconstruct_plane_4.Origin, Axis=deconstruct_plane_4.XAxis)  # -> Geometry, Transform

plane_7 = Plane(rotate_3d_3.Geometry)

# ----
# multiple elements
panel_3 = Panel("-2")
shift_paths = ShiftPaths(Data=plane_7, Offset=panel_3)

# ----
# single element
flatten_tree = FlattenTree(Tree=plane_7, Path="{0}")

# ----
# element in jaw
brep_11 = Brep(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)

# ----
# robot end effector
mesh = Mesh(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)

scale = Scale(Geometry=brep_11, Center=Point(0, 0, 0), Factor="1000")  # -> Geometry, Transform
scale_2 = Scale(Geometry=mesh, Center=Point(0, 0, 0), Factor="1000")  # -> Geometry, Transform
volume = Volume(Geometry=scale.Geometry)  # -> Volume, Centroid
point_4 = Point(volume.Centroid)
xz_plane = XZPlane(Origin=Point(0, 0, 0))

# ----
# gripper front
point_5 = Point(point_4)

number_slider_6 = Slider(4.2, range=1..10)
plane_origin = PlaneOrigin(Base=xz_plane, Origin=point_5)
plane_8 = Plane(shift_paths)
orient_2 = Orient(Source=plane_origin, Target=plane_8)  # -> Geometry, Transform
deconstruct_plane_5 = DeconstructPlane(Plane=plane_origin)  # -> Origin, XAxis, YAxis, ZAxis
multiplication_5 = Multiplication(A=deconstruct_plane_5.YAxis, B=number_slider_6)
multiplication_6 = Multiplication(A=deconstruct_plane_5.XAxis, B=number_slider_6)
multiplication_7 = Multiplication(A=deconstruct_plane_5.ZAxis, B=number_slider_6)
panel_4 = Panel("C:\Users\harry\Documents\compas-dev\compas_fab_choreo_workshop\compas_fab.assembly_tests\gh_prototypes\ur_picknplace")

# ----
# gripper in place pose
transform = Transform(Geometry=scale_2.Geometry, Transform=orient_2.Transform)
mesh_2 = Mesh(transform)

# ----
# z axis along the elemental longitude axis
# x axis the opposite of the contact face normal
colour_rgb_3 = ColourRGB(Alpha=255, Red="255", Green=0, Blue=0)
colour_rgb_4 = ColourRGB(Alpha=255, Red=0, Green=0, Blue="255")
colour_rgb_5 = ColourRGB(Alpha=255, Red=0, Green="255", Blue=0)
vector_display_ex = VectorDisplayEx(Point=deconstruct_plane_5.Origin, Vector=multiplication_6, Colour=colour_rgb_3, Width=2)
vector_display_ex_2 = VectorDisplayEx(Point=deconstruct_plane_5.Origin, Vector=multiplication_5, Colour=colour_rgb_5, Width=2)
vector_display_ex_3 = VectorDisplayEx(Point=deconstruct_plane_5.Origin, Vector=multiplication_7, Colour=colour_rgb_4, Width=2)

# ----
# pick to place transf
transform_2 = Transform(orient.Transform)

mesh_3 = Mesh(mesh_2)

# ----
# EE preview in pick
mesh_4 = Mesh(mesh_2)

concatenate = Concatenate(Fragment_A=panel_4, A="\", Fragment_B="ur_joint.jpg")
transform_3 = Transform(Geometry=mesh_3, Transform=transform_2)  # -> simplify(Geometry)

# ----
# element id
number_slider_7 = Slider(0, range=0..13)

# ----
# grasp poses in pick
plane_9 = Plane(shift_paths)

mesh_5 = Mesh(mesh_4)
tree_statistics = TreeStatistics(Tree=mesh_5)  # -> Paths, Length, Count
mesh_6 = Mesh(transform_3)
deconstruct_path = DeconstructPath(Branch=tree_statistics.Paths)  # -> simplify(Indices)
list_item_4 = ListItem(List=deconstruct_path, Index=0, Wrap=True)
panel_5 = Panel("    ur5_start_conf = [0,-1.65715,1.71108,-1.62348,-1.55893,2.75828]")
create_set = CreateSet(List=flatten(list_item_4))  # -> Set, Map
list_item_5 = ListItem(List=create_set.Set, Index=number_slider_7, Wrap=False)
transform_4 = Transform(Geometry=plane_9, Transform=transform_2)
concatenate_2 = Concatenate(B="{", Fragment_A=list_item_5, A=";", Fragment_B="*", C="}")
brep_12 = Brep(brep_10)
brep_13 = Brep(simplify(graft(brep_12)))

# ----
# grasp poses in place
plane_10 = Plane(transform_4)

brep_14 = Brep(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)
merge_3 = Merge(
    Data1=Slider(0, range=-6.28..6.28),
    Data2=Slider(-1.6, range=-6.28..6.28),
    Data3=Slider(1.5, range=-3.14..3.14),
    Data4=Slider(-1.6, range=-6.28..6.28),
    Data5=Slider(0, range=-6.28..6.28),
    Data6=Slider(0, range=-6.28..6.28))
split_tree = SplitTree(Data=mesh_5, Masks=flatten(concatenate_2))  # -> Positive, Negative
split_tree_2 = SplitTree(Data=mesh_6, Masks=flatten(concatenate_2))  # -> Positive, Negative
brep_15 = Brep(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)
list = ValueList({"ur3", "ur5"}, selected="ur3")

# ----
# candidate id
number_slider_8 = Slider(0, range=0..50)

group = Group(Objects=brep_13)
mesh_brep = MeshBrep(
    Brep=[brep_15, brep_14],
    Settings={GridMaxCount=0, GridMinCount=16, JaggedSeams=False, MaxEdgeLength=0, MinEdgeLength=0.0001, MinTolerance=0, Refine=True, RefineAngle=0, RelativeTolerance=0.65, SimplePlanes=True, Tolerance=0})

# ----
# get robot and table mesh
# from compas_fab
panel_6 = Panel("1000")
jt_names = GhPythonScript(scale=panel_6, jt_val=merge_3, robot_type=list)  # -> jt_names, robot_mesh, table_mesh; inputs scale: Int32, jt_val: list
# ---------- jt_names: Python ----------
__author__ = "harry"
__version__ = "2019.08.12"

import rhinoscriptsyntax as rs

import compas
from compas.geometry import Box, Frame
from compas.datastructures import Mesh
from compas.robots import RobotModel

import compas_fab
from compas_fab.robots import RobotSemantics
from compas_fab.robots import Robot as RobotClass
from compas.robots import LocalPackageMeshLoader
from compas_fab.robots.configuration import Configuration

from compas_fab.ghpython import RobotArtist
from compas_ghpython.artists import MeshArtist

# draw table
#table = Box(Frame((-0.12, -0.3, 0.0), (1, 0, 0), (0, 1, 0)), 0.8, 0.6, -0.8)
#table_m = Mesh.from_vertices_and_faces(table.vertices, table.faces)
#for key, v in table_m.vertex.items():
#    for k in v.keys():
#        table_m.vertex[key][k] *= scale
#
#table_artist = MeshArtist(table_m)
#table_mesh = table_artist.draw()

# draw robot
if robot_type == 'ur3':
    urdf_filename = compas_fab.get('universal_robot/ur_description/urdf/ur3.urdf')
else:
    urdf_filename = compas_fab.get('universal_robot/ur_description/urdf/ur5.urdf')

model = RobotModel.from_urdf_file(urdf_filename)
loader = LocalPackageMeshLoader(compas_fab.get('universal_robot'), 'ur_description')
model.load_geometry(loader)

robot = RobotClass(model, artist=RobotArtist(model))
robot.scale(scale)

#jt_val = [0,-1.65715,1.71108,-1.62348,-1.55893,2.75828]
conf = Configuration.from_revolute_values(jt_val)

robot.update(conf)

robot_mesh = robot.draw_visual()

jt_names = robot.get_configurable_joint_names()
# ---------- end jt_names ----------
mesh_7 = Mesh(jt_names.robot_mesh)
mesh_8 = Mesh(mesh_brep)

panel_7 = Panel(jt_names.jt_names)
data = Data(group)
plane_11 = Plane(plane_9)
ungroup = Ungroup(Group=data)  # -> simplify(Objects)

# ----
# visualize end effector poses
list_item_6 = ListItem(List=split_tree.Positive, Index=number_slider_8, Wrap=False)
list_item_7 = ListItem(List=split_tree_2.Positive, Index=number_slider_8, Wrap=False)

# ----
# world from pick grasp poses
plane_12 = Plane(plane_11)

deconstruct_plane_6 = DeconstructPlane(Plane=plane_12)  # -> Origin, XAxis, YAxis, ZAxis
reverse_2 = Reverse(Vector=deconstruct_plane_6.XAxis)
multiplication_8 = Multiplication(A=reverse_2, B=Slider(50, range=0..100))
move_4 = Move(Geometry=plane_12, Motion=multiplication_8)  # -> Geometry, Transform

# ----
# pkg clone dir, change me!
panel_8 = Panel("C:\Users\harry\Documents\compas-dev")

mesh_brep_2 = MeshBrep(
    Brep=ungroup,
    Settings={GridMaxCount=0, GridMinCount=16, JaggedSeams=False, MaxEdgeLength=0, MinEdgeLength=0.0001, MinTolerance=0, Refine=True, RefineAngle=0, RelativeTolerance=0.65, SimplePlanes=True, Tolerance=0})
number_slider_9 = Slider(0, range=0..20)

# ----
# shape meshes
# (aligned w/ verts)
mesh_9 = Mesh(mesh_brep_2)

# ----
# world_from_approach
plane_13 = Plane(move_4.Geometry)

concatenate_3 = Concatenate(FragmentA="C:\Users\yijiangh\Documents\compas-dev", FragmentB="\compas_fab\src\compas_fab\data\choreo_instances")
list_item_8 = ListItem(List=plane_12, Index=number_slider_9, Wrap=True)
list_item_9 = ListItem(List=plane_13, Index=number_slider_9, Wrap=True)

# ----
# element pose in place
plane_14 = Plane(plane_4)

# ----
# element pose in pick
plane_15 = Plane(plane_3)

# ----
# annotate sequence
tree_statistics_2 = TreeStatistics(Tree=plane_14)  # -> Paths, Length, Count
series = Series(Start="0", Step=1, Count=tree_statistics_2.Count)

# ----
# base frame for describing the geometry
xy_plane = XYPlane(Origin=Point(0, 0, 0))

panel_9 = Panel("ur_picknplace_single_piece")
boolean_toggle = BooleanToggle(True)
generate_pkg = Button()
plane_16 = Plane(flatten(plane_14))
plane_17 = Plane(flatten(plane_15))
mesh_10 = Mesh(simplify(graft(mesh_8)))
panel_10 = Panel("""0
1
2""")
ghpython_script = GhPythonScript(
    virtual_joint_connected_e_ids=panel_10,
    grounded_element_ids="0",
    element_geometries_in_place=mesh_9,
    world_from_place_poses=plane_16,
    world_from_pick_poses=plane_17,
    world_from_pick_grasp_poses=plane_12,
    world_from_approach_poses=plane_13,
    base_frame=xy_plane,
    file_path=concatenate_3,
    pkg_name="ur_picknplace_multiple_piece",
    assembly_type="picknplace",
    unit="millimeter",
    generate=generate_pkg,
    predefined_sequence=series,
    static_obstacle_meshes=mesh_10)  # -> out; inputs virtual_joint_connected_e_ids: tree of Int32, grounded_element_ids: list of Int32, grounded_virtual_joint_ids: list of Int32, element_geometries_in_place: tree of Mesh, world_from_place_poses: list of Plane, world_from_pick_poses: list of Plane, world_from_pick_grasp_poses: tree of Plane, world_from_approach_poses: tree of Plane, base_frame: Plane, generate: Boolean, predefined_sequence: list, static_obstacle_meshes: tree of Mesh
# ---------- ghpython_script: Python ----------
import sys
import copy
import os
import json
from collections import OrderedDict

import Rhino.Geometry as rg
import ghpythonlib.components as ghcomp
import ghpythonlib.treehelpers as th

from compas.datastructures import Mesh
from compas.geometry import Frame, Point
from compas.geometry import Transformation, transform_points, cross_vectors
from compas_ghpython.utilities import draw_mesh, draw_frame

from compas_ghpython.utilities import unload_modules
unload_modules('compas_fab.assembly.datastructures')

from compas_fab.assembly.datastructures import Assembly, Element, VirtualJoint, UnitGeometry, Grasp
from compas_fab.assembly.datastructures.utils import transform_cmesh, transform_cmesh_to_origin

##########################################
def tree_to_lists(input):
    """converts a depth-2 GH datatree to a list of lists
    """
    all = []
    for path in input.Paths:
        branch_list = []
        for obj in input.Branch(path):
            branch_list.append(obj)
        all.append(branch_list)
    return all

def rPt2cPt(rPt):
    """
    Convert Rhino point to compas point
    :param rPt:
    :return:
    """
    return Point(rPt.X, rPt.Y, rPt.Z)

def rPln2cFrame(rplane):
    """converts a rhino plane to compas frame
    """
    return Frame(rplane.Origin, rplane.XAxis, rplane.YAxis)

def rMesh2cMesh(rg_mesh):
    if type(rg_mesh) == rg.Mesh:
        #single mesh
        compas_mesh_vertices = rg_mesh.Vertices.ToPoint3dArray()
        compas_mesh_faces = rg_mesh.Faces.ToIntArray(True)
        compas_mesh_faces = [compas_mesh_faces[i:i + 3] for i in range(0, len(compas_mesh_faces), 3)]
        return Mesh.from_vertices_and_faces(compas_mesh_vertices, compas_mesh_faces)
    else:
        #array of meshes
        meshes = []
        for m in rg_mesh:
            compas_mesh_vertices = m.Vertices.ToPoint3dArray()
            compas_mesh_faces = m.Faces.ToIntArray(True)
            compas_mesh_faces = [compas_mesh_faces[i:i + 3] for i in range(0, len(compas_mesh_faces), 3)]
            meshes.append( Mesh.from_vertices_and_faces(compas_mesh_vertices, compas_mesh_faces) )
        return meshes


def draw_assembly_object_cmeshes(asm, e_id, stage='place'):
    """
    Parameters:
        stage: flag for 'place', 'pick'
    """
    if stage == 'place':
        return [draw_mesh(*cm.to_vertices_and_faces()) for cm in asm.element_geometry_in_place_pose(e_id)]
    elif 'pick':
        return [draw_mesh(*cm.to_vertices_and_faces()) for cm in asm.element_geometry_in_pick_pose(e_id)]
    else:
        return None

##########################################
# main

# TODO: convert tree of e_ids into virtual joints

if generate:
    asm = Assembly()
    
    # create assembly objects
    e_geos = tree_to_lists(element_geometries_in_place)
    vj_e_ids = tree_to_lists(virtual_joint_connected_e_ids)
    grasp_pose_lists = tree_to_lists(world_from_pick_grasp_poses)
    approach_pose_lists = tree_to_lists(world_from_approach_poses)
    static_obs_lists = tree_to_lists(static_obstacle_meshes)
    
#    print(e_geos)
    
    for id, rm_list in enumerate(e_geos):
        is_grounded = id in grounded_element_ids
        e = Element(id, is_grounded=is_grounded)
        world_from_place_frame = rPln2cFrame(world_from_place_poses[id])
        world_from_pick_frame = rPln2cFrame(world_from_pick_poses[id])
        print('{}, {}'.format(id, len(grasp_pose_lists[id])))
        
        grasp_frames = [rPln2cFrame(gpose) for gpose in grasp_pose_lists[id]]
        approach_frames = [rPln2cFrame(apppose) for apppose in approach_pose_lists[id]]
        
        grasps = []
        grasp_id_cnt = 0
        for world_from_grasp, world_from_approach in zip(grasp_frames, approach_frames):
            grasps.append(Grasp.from_frames(id, grasp_id_cnt, world_from_pick_frame, world_from_grasp, world_from_approach))
            grasp_id_cnt += 1
        
        cmesh_list = [transform_cmesh_to_origin(rMesh2cMesh(rm), world_from_place_frame) for rm in rm_list]
        unit_geo = UnitGeometry(name='element_'+str(id), mesh=cmesh_list, 
            initial_frame=world_from_pick_frame, goal_frame=world_from_place_frame, grasps=grasps)
        
        asm.add_element(e, unit_geo)
    
    for id, c_e_ids in enumerate(vj_e_ids):
        is_grounded = id in grounded_virtual_joint_ids
        asm.add_virtual_joint(VirtualJoint(id, connected_element_ids=c_e_ids, 
            is_grounded=is_grounded))
    
    so_unit_geos = []
    for so_id, s_list in enumerate(static_obs_lists):
        so_unit_geos.append(UnitGeometry(name='static_obstacle_'+str(so_id), mesh=[rMesh2cMesh(so) for so in s_list]))
        
    asm.static_obstacle_geometries = so_unit_geos

    asm.to_package(file_path, pkg_name, assembly_type, model_type, unit, predefined_sequence)
# ---------- end ghpython_script ----------
panel_11 = Panel(ghpython_script)

# ==== cluster Cluster
brep = ClusterInput()
brep_2 = Brep(brep)
deconstruct_brep = DeconstructBrep(Brep=brep_2)  # -> Faces, Edges, Vertices
volume = Volume(Geometry=brep_2)  # -> Volume, Centroid
list_item = ListItem(List=deconstruct_brep.Faces, Index=0, Wrap=True)
point = Point(volume.Centroid)
deconstruct_brep_2 = DeconstructBrep(Brep=list_item)  # -> Faces, Edges, Vertices
list_item_2 = ListItem(List=deconstruct_brep_2.Edges, Index=0, Wrap=True)  # -> Item, Item1
line_line = LineLine(LineA=list_item_2.Item, LineB=list_item_2.Item1)
plane_origin = PlaneOrigin(Base=line_line, Origin=point)
plane = ClusterOutput(plane_origin)
