# Grasshopper definition voronoi_jack_urdf_export.gh (Grasshopper 1.0.7)
# plug-ins: TTToolbox, Kangaroo Components, KUKA|prc - parametric robot control

# ----
# Box size parameters
number_slider = Slider(15, range=0..300)
number_slider_2 = Slider(15, range=0..300)
number_slider_3 = Slider(30, range=0..300)

# ----
# voronoi pts amount
number_slider_4 = Slider(30, range=0..100)

# ----
# Vanilla 3D Voronoi
vector_xyz = VectorXYZ(XComponent=number_slider_2, YComponent=number_slider_3, ZComponent=number_slider)  # -> Vector, Length
xy_plane = XYPlane(Origin=Point(0, 0, 0))
move = Move(Geometry=xy_plane, Motion=vector_xyz.Vector)  # -> Geometry, Transform
box_2pt = Box2Pt(PointA=xy_plane, PointB=move.Geometry, Plane=xy_plane)
populate_3d = Populate3D(Region=box_2pt, Count=number_slider_4, Seed=Slider(32, range=0..100))
removeduplicatepts = RemoveDuplicatePts(Points=populate_3d, Tolerance=0.01)
brep_edges = BrepEdges(Brep=box_2pt)  # -> Naked, Interior, NonManifold
voronoi_3d = Voronoi3D(Points=removeduplicatepts, Box=box_2pt)  # -> Cells, Boundary
brep = Brep(voronoi_3d.Cells)
deconstruct_brep = DeconstructBrep(Brep=brep)  # -> Faces, simplify(Edges), Vertices
curve = Curve(brep_edges.Interior)
curve_2 = Curve(deconstruct_brep.Edges)
end_points = EndPoints(Curve=curve_2)  # -> Start, End

# ----
# traction force formula
# a*(d^(-n))
a = Slider(0, range=0..200)
n = Slider(1, range=1..5)

# ----
# vanilla voronoi
curve_3 = Curve(curve_2)

curve_4 = Curve(curve_3)
data_dam = DataDam(DataDataA=curve_4, BufferDelay=10000000, BufferMode=0)
curve_5 = Curve(flatten(data_dam))
removeduplicatelines = RemoveDuplicateLines(Lines=curve_5, Tolerance=0.01)
end_points_2 = EndPoints(Curve=removeduplicatelines)  # -> Start, End
merge = Merge(Data1=end_points_2.Start, Data2=end_points_2.End)
removeduplicatepts_2 = RemoveDuplicatePts(Points=merge, Tolerance=0.01)

# ----
# containing block
box = Box(box_2pt)

brep_closest_point = BrepClosestPoint(Point=removeduplicatepts_2, Brep=box)  # -> Point, Normal, Distance
smaller_than = SmallerThan(FirstNumber=brep_closest_point.Distance, SecondNumber="1e-3")  # -> SmallerThan, OrEqualTo
deconstruct_brep_2 = DeconstructBrep(Brep=box)  # -> Faces, Edges, Vertices
dispatch = Dispatch(List=removeduplicatepts_2, DispatchPattern=smaller_than.SmallerThan)  # -> ListA, ListB
curve_6 = Curve(deconstruct_brep_2.Edges)
panel = Panel("""e
f
g
h""")
panel_2 = Panel("""a
b
c
d""")

# ----
# boundary pts
point = Point(dispatch.ListA)

# ----
# corner anchor pts
point_2 = Point(deconstruct_brep_2.Vertices)

number_slider_5 = Slider(0, range=0..6)
cross_reference = CrossReference(ListListA=panel_2, ListListB=panel, CrossMode=5)  # -> ListListA, ListListB
list_item = ListItem(List=cross_reference.ListListA, Index=number_slider_5, Wrap=True)
list_item_2 = ListItem(List=cross_reference.ListListB, Index=number_slider_5, Wrap=True)
panel_3 = Panel(list_item)
panel_4 = Panel(list_item_2)
panel_5 = Panel(cross_reference.ListListB)
panel_6 = Panel(cross_reference.ListListA)

# ----
# boundary pts
# except anchors
# internal pts
# corner anchor pts
set_difference = SetDifference(SetA=point, SetB=point_2)
point_3 = Point(point_2)
point_4 = Point(dispatch.ListB)
entwine = Entwine(Branch00=point_3, Branch01=set_difference, Branch02=point_4, FlattenInputs=True)

# ----
# pts on each boundary crvs
curve_closest_point = CurveClosestPoint(Point=set_difference, Curve=simplify(graft(curve_6)))  # -> Point, Parameter, Distance
smaller_than_2 = SmallerThan(FirstNumber=curve_closest_point.Distance, SecondNumber="1e-3")  # -> SmallerThan, OrEqualTo
dispatch_2 = Dispatch(List=set_difference, DispatchPattern=smaller_than_2.SmallerThan)  # -> ListA, ListB
point_5 = Point(simplify(dispatch_2.ListA))

# ----
# all pts
point_6 = Point(flatten(entwine))

curve_7 = Curve(simplify(graft(curve_6)))

# ----
# all pts
# (including bdy pts)
point_7 = Point(removeduplicatepts_2)

curve_8 = Curve(removeduplicatelines)

# ----
# compute elements' distance to each pt
curve_closest_point_2 = CurveClosestPoint(Point=graft(point_7), Curve=curve_8)  # -> Point, Parameter, Distance

# ----
# get connected lines for each pt
number_slider_6 = Slider(0.001, range=0..0.001)
smaller_than_3 = SmallerThan(FirstNumber=curve_closest_point_2.Distance, SecondNumber=number_slider_6)  # -> SmallerThan, OrEqualTo
dispatch_3 = Dispatch(List=curve_8, DispatchPattern=smaller_than_3.SmallerThan)  # -> ListA, ListB
curve_9 = Curve(simplify(dispatch_3.ListA))

# ----
# for each ngh, 2-line tuple
# C^(2)_{4} in the case of Voronoi
# (blc the valence is 4)
# see example here
cross_reference_2 = CrossReference(ListListA=curve_9, ListListB=curve_9, CrossMode=5)  # -> simplify(graft(ListListA)), simplify(graft(ListListB))

explode = Explode(Curve=cross_reference_2.ListListA, Recursive=True)  # -> Segments, simplify(Vertices)
explode_2 = Explode(Curve=cross_reference_2.ListListB, Recursive=True)  # -> Segments, simplify(Vertices)

# ----
# the other unshared ends
set_difference_s = SetDifferenceS(SetA=explode.Vertices, SetB=explode_2.Vertices)

# ----
# shared node for each 2-line tuple
set_intersection = SetIntersection(SetA=explode.Vertices, SetB=explode_2.Vertices)

list_item_3 = ListItem(List=set_difference_s, Index=0, Wrap=True)  # -> Item, Item1
vector_2pt = Vector2Pt(PointA=set_intersection, PointB=list_item_3.Item, Unitize=False)  # -> Vector, Length
vector_2pt_2 = Vector2Pt(PointA=set_intersection, PointB=list_item_3.Item1, Unitize=False)  # -> Vector, Length
plane_3pt = Plane3Pt(PointA=set_intersection, PointB=list_item_3.Item, PointC=list_item_3.Item1)
pi = Pi(Factor=1)
angle = Angle(VectorA=vector_2pt.Vector, VectorB=vector_2pt_2.Vector, Plane=plane_3pt)  # -> simplify(Angle), Reflex
larger_than = LargerThan(FirstNumber=angle.Angle, SecondNumber=pi)  # -> LargerThan, OrEqualTo
mass_addition = MassAddition(Input=flatten(larger_than.LargerThan))  # -> Result, PartialResults

# ----
# correct if 0
# (all < 180 deg)
panel_7 = Panel(mass_addition.Result)

# ----
# boundary pulling strength
number_slider_7 = Slider(1900, range=0..10000)

# ----
# Input minimum distance
# (collision ball)
number_slider_8 = Slider(2.667, range=0..10)

# ----
# boundary pts
point_8 = Point(point)

# ----
# block container
brep_2 = Brep(box)

# ----
# all lines
curve_10 = Curve(removeduplicatelines)

# ----
# angle bending resistance
number_slider_9 = Slider(200, range=0..1000)

# ----
# shared (start) node
point_9 = Point(set_intersection)

# ----
# the other two ends
point_10 = Point(list_item_3.Item)
point_11 = Point(list_item_3.Item1)

# ----
# boundary crvs
curve_11 = Curve(curve_7)

# ----
# pts on bdy crvs
point_12 = Point(point_5)

# ----
# Boundary preserving constraints
number_slider_10 = Slider(0.552, range=0..1)
collidemesh = CollideMesh(Solid=box, Points=dispatch.ListB, Hardness=number_slider_10, Traction=Slider(0.552, range=0..1))  # disabled
pulltomesh = PullToMesh(ConstraintMesh=brep_2, Points=point_8, PullStrength=number_slider_7)
curvepull = CurvePull(Curve=curve_11, Points=point_12, Strength=Slider(1760, range=0..100000))

# ----
# corner anchor pts
point_13 = Point(point_3)

# ----
# all pts (design variables)
point_14 = Point(point_6)

# ----
# all pts
point_15 = Point(point_6)

# ----
# Angle preserving constraints
bend = Bend(Point1=point_10, Point2=point_9, Point3=point_11, BendStrength=number_slider_9, RestAngle=angle.Angle)

# ----
# all pts
point_16 = Point(point_6)

# ----
# block container's
# boundary crvs
curve_12 = Curve(graft(curve_6))

# ----
# pts on boundary crvs
# (tree structure matched
# corresponding crvs)
point_17 = Point(point_5)

# ----
# original crvs
end_points_3 = EndPoints(Curve=removeduplicatelines)  # -> Start, End

member_index = MemberIndex(Set=point_6, Member=end_points_3.End)  # -> Index, Count
member_index_2 = MemberIndex(Set=point_6, Member=end_points_3.Start)  # -> Index, Count

# ----
# our goal min circle radius
number = Number(number_slider_8)
panel_8 = Panel(number)

# ----
# pwf file generation
cluster = Cluster()

panel_9 = Panel("1.5")
concatenate = Concatenate(A="{", Fragment_A="*", C=";", B=Slider(0, range=0..1), Fragment_B="}")
concatenate_2 = Concatenate(A="{", Fragment_A="*", C=";", B=Slider(1, range=0..1), Fragment_B="}")
number_slider_11 = Slider(0.5, range=0..2)

# ----
# joint depth
number_slider_12 = Slider(0.7, range=0..2)

division = Division(A=number_slider_12, B="2")
negative = Negative(Value=division)
negative_2 = Negative(Value=division)

# ----
# tube's radius
number_2 = Number(number_slider_11)

number_3 = Number(number_2)
scale_factor = Slider(15, range=1..20)
x_axis_transl = Slider(400, range=0..1000)

# ----
# source geometry
brep_3 = Brep(Tree({0}: [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], {1}: [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], {2}: [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], {3}: [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], {4}: [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], {5}: [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]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))

number_4 = Number("0")
number_5 = Number("0")
series = Series(Start=0, Step=1, Count=Slider(4, range=0..147))
construct_path = ConstructPath(Indices=graft(series))  # -> flatten(Branch)
construct_path_2 = ConstructPath(Indices=Slider(3, range=0..3))
xy_plane_2 = XYPlane(Origin=Point(0, 0, 0))

# ----
# bake and export sub routine
panel_10 = Panel("D:\Dropbox (MIT)\Projects\Choreo\Software\picknplace\urdf_exporter\objs\")
py_bake = PythonScript(active=Button(), path_out=panel_10, file_prefix="TestExport", file_suffix=".obj")  # -> out, object_guid; inputs geo: list
# ---------- py_bake: Python ----------
import os
import rhinoscriptsyntax as rs
import scriptcontext
import Rhino

#----------------functions----------------
def ExportAsObj(id, obj, filePath, file_prefix, file_suffix):
    #filepath = "C:\Test\TestExport.obj"
    if not os.path.isdir(filePath):
        os.mkdir(filePath)
    fileFullPath = filePath + file_prefix + '_' + str(id) + file_suffix
    
    write_options = Rhino.FileIO.FileWriteOptions()
    write_options.WriteSelectedObjectsOnly = True
    
    # select the object
    obj.Select(True)
    
    obj_options = Rhino.FileIO.FileObjWriteOptions(write_options)
    obj_options.UseSimpleDialog = True
    obj_options.CreateNgons = False
    obj_options.MapZtoY = False
    obj_options.ExportNormals = True
    obj_options.ExportMaterialDefinitions = False
    
    # texture stuff
    obj_options.ExportTcs = False
    obj_options.ExportVcs = False
    
    #obj_options.ObjGroupNames = 1

    rc = Rhino.FileIO.FileObj.Write(fileFullPath, Rhino.RhinoDoc.ActiveDoc, obj_options)
    if rc == Rhino.PlugIns.WriteFileResult.Success:
        print "Success, file saved:", fileFullPath
    else:
        print "Error saving file:", fileFullPath
    
    # de-select the object
    obj.Select(False)
##########################################

if active:
    for i, geo in enumerate(geo): 
        #we create or use some geometry
        geo_id = geo # or rs.AddLine((0,1,2), (9,8,7))
        
        #(we could do all operations here...
        
        scriptcontext.doc = ghdoc
        #we obtain the reference in the Rhino doc
        doc_object = rs.coercerhinoobject(geo_id)
        print('the type of odc_object is: ' + str(type(doc_object)))
        
        attributes = doc_object.Attributes
        print('the type of attributes is: ' + str(type(attributes)))
        geometry = doc_object.Geometry
        print('the type of geometry is: ' + str(type(geometry)))
        
        #we change the scriptcontext
        scriptcontext.doc = Rhino.RhinoDoc.ActiveDoc
        
        #we add both the geometry and the attributes to the Rhino doc
        rhino_geo_id = scriptcontext.doc.Objects.Add(geometry, attributes)
        rhino_geo = scriptcontext.doc.Objects.Find(rhino_geo_id)
        print('the Rhino doc ID is: ' + str(rhino_geo_id))
        
#        if export:
        ExportAsObj(i, rhino_geo, path_out, file_prefix, file_suffix)

#we put back the original Grasshopper document as default
scriptcontext.doc = ghdoc
# ---------- end py_bake ----------
panel_11 = Panel(py_bake.out)

panel_12 = Panel("E:\Dropbox (MIT)\Projects\Choreo\Software\picknplace\urdf_exporter")
generate_pkg = Button()
ghpython_script = GhPythonScript()  # -> out, a
# ---------- ghpython_script: Python ----------
## Frame example
from compas.geometry import Frame
from compas_ghpython import xdraw_frame
from compas.geometry.xforms import Transformation
from compas.geometry import transform_points
from compas_ghpython import xdraw_points

point = (0.0, 0.0, 63.0)
xaxis = (1.0, 0.0, 0.0)
yaxis = (0.0, 1.0, 0.0)
F1 = Frame(point, xaxis, yaxis)
a = [xdraw_frame(F1)]
point = (146.00, 150.00, 161.50)
xaxis = (0.9767, 0.0010, -0.214)
yaxis = (0.1002, 0.8818, 0.4609)
F2 = Frame(point, xaxis, yaxis)
a.append(xdraw_frame(F2))

a = []
P1 = (35., 35., 35.)
a += xdraw_points([{'pos': P1}])
world = Frame.worldXY()
Tw = Transformation.from_frame_to_frame(world, F1)
Pw = transform_points([P1], Tw)
a += xdraw_points([{'pos': Pw[0]}])
T = Transformation.from_frame_to_frame(F1, F2)
P2 = transform_points(Pw, T)
a += xdraw_points([{'pos': P2[0]}])
# ---------- end ghpython_script ----------
panel_13 = Panel(ghpython_script.a)
xy_plane_3 = XYPlane(Origin=Point(0, 0, 0))
# should rotate 180 but ...
number_slider_13 = Slider(0, range=0..1000)
deconstruct_plane = DeconstructPlane(Plane=xy_plane_3)  # -> Origin, XAxis, YAxis, ZAxis

# ----
# Robot Model
# End effector setup
brep_4 = Brep([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])
kuka_agilus_kr6_kr10_r900 = KUKAAgilusKR6KR10R900(highresactive=False, infiniterot=False)
custom_tool_for_kuka_prc = CustomToolForKUKAPrc(
    CustomToolGeometry=brep_4,
    toolid=2,
    toolvala=0,
    toolvalb=90,
    toolvalc=0,
    toolvalx=145.336,
    toolvaly=1.919,
    toolvalz=96.286,
    valuesset=True)

rotate_3d = Rotate3D(Geometry=xy_plane_3, Angle=degrees(number_slider_13), Center=xy_plane_3, Axis=deconstruct_plane.YAxis)  # -> Geometry, Transform
kuka_prc_axis_movement = KUKAPrcAXISMovement(Axis1=0, Axis2=-90, Axis3=90, Axis4=0, Axis5=0, Axis6=0, extaxenabled=False, impedancemode=False, interpolation="C_PTP")
kuka_prc_core = KUKAPrcCORE(
    SimulationSlider=Slider(0.2122, range=0..1),
    KUKAPrcCommands=kuka_prc_axis_movement,
    KUKAPrcTool=custom_tool_for_kuka_prc,
    KUKAPrcRobot=kuka_agilus_kr6_kr10_r900,
    LINstartspeed=0.1,
    PRC_SaveNameExpose=False,
    PTPstartspeed=5,
    acc_cp=nan,
    acc_ptp=-1,
    basea=0,
    baseb=0,
    basec=0,
    baseindex=0,
    basex=0,
    basey=0,
    basez=0,
    camrobformatting="""&ACCESS RVP
&REL 1
&PARAM TEMPLATE = C:\KRC\Roboter\Template\vorgabe
&PARAM EDITMASK = *
[PROJECTNAME]

[SPLITDEFS]

;FOLD INI
;FOLD BASISTECH INI
GLOBAL INTERRUPT DECL 3 WHEN $STOPMESS==TRUE DO IR_STOPM ( )
INTERRUPT ON 3
BAS (#INITMOV,0 )
;ENDFOLD (BASISTECH INI)
;ENDFOLD (INI)

[STARTAXPOS]

[SETPARAMETERS]

[COMMANDS]

END""",
    camrobon=False,
    checkallcolls=False,
    enda01=5,
    enda02=-90,
    enda03=100,
    enda04=5,
    enda05=10,
    enda06=-5,
    ende01=0,
    ende02=0,
    ende03=0,
    ende04=0,
    endindex=0,
    haltatend=False,
    hash=7844,
    initialstatus="110",
    int_advance=-1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)  # -> simplify(RobotGeometry), AnalysisOutput; disabled

# ----
# point-traction morph method
point_18 = Point(simplify(graft(end_points.End)))
curve_closest_point_3 = CurveClosestPoint(Point=point_18, Curve=curve)  # -> Point, Parameter, simplify(Distance)
point_19 = Point(simplify(graft(end_points.Start)))
curve_closest_point_4 = CurveClosestPoint(Point=point_19, Curve=curve)  # -> Point, Parameter, simplify(Distance)
number_slider_14 = Slider(0.08, range=0..0.1)
number_slider_15 = Slider(0.5, range=0..1)
smaller_than_4 = SmallerThan(FirstNumber=curve_closest_point_4.Distance, SecondNumber=number_slider_14)  # -> SmallerThan, OrEqualTo
smaller_than_5 = SmallerThan(FirstNumber=curve_closest_point_3.Distance, SecondNumber=number_slider_14)  # -> SmallerThan, OrEqualTo
boolean = Boolean(invert(smaller_than_5.SmallerThan))
boolean_2 = Boolean(invert(smaller_than_4.SmallerThan))
point_20 = Point(point_18)
point_21 = Point(point_19)
mass_multiplication = MassMultiplication(Input=boolean)  # -> Result, PartialResults
mass_multiplication_2 = MassMultiplication(Input=boolean_2)  # -> Result, PartialResults
multiplication = Multiplication(A=number_slider, B=number_slider_15)
multiplication_2 = Multiplication(A=number_slider_2, B=number_slider_15)
multiplication_3 = Multiplication(A=number_slider_3, B=number_slider_15)
boolean_3 = Boolean(invert(mass_multiplication.Result))
boolean_4 = Boolean(invert(mass_multiplication_2.Result))
dispatch_4 = Dispatch(List=point_21, DispatchPattern=boolean_4)  # -> ListA, ListB
dispatch_5 = Dispatch(List=point_20, DispatchPattern=boolean_3)  # -> ListA, ListB

# ----
# traction point
construct_point = ConstructPoint(XCoordinate=multiplication_2, YCoordinate=multiplication_3, ZCoordinate=multiplication)

# ----
# boundary points
point_22 = Point(dispatch_4.ListA)

# ----
# boundary points
point_23 = Point(dispatch_5.ListA)

# ----
# inner points
point_24 = Point(dispatch_4.ListB)

# ----
# inner points
point_25 = Point(dispatch_5.ListB)

# ----
# traction point
point_26 = Point(construct_point)

# ----
# boundary points
point_27 = Point(point_23)

# ----
# boundary points
point_28 = Point(point_22)

point_29 = Point(point_25)
point_30 = Point(point_24)
distance = Distance(PointA=point_26, PointB=point_30)
vector_2pt_3 = Vector2Pt(TractionPoint=point_26, PointB=point_30, Unitize=True)  # -> Vector, Length
distance_2 = Distance(PointA=point_26, PointB=point_29)
vector_2pt_4 = Vector2Pt(TractionPoint=point_26, PointB=point_29, Unitize=True)  # -> Vector, Length
evaluate = Evaluate(Expression="a*(d^(-n))", d=distance, n=n, a=a)
evaluate_2 = Evaluate(Expression="a*(d^(-n))", d=distance_2, n=n, a=a)
multiplication_4 = Multiplication(A=vector_2pt_3.Vector, B=evaluate)
multiplication_5 = Multiplication(A=vector_2pt_4.Vector, B=evaluate_2)
move_2 = Move(Geometry=point_30, Motion=multiplication_4)  # -> Geometry, Transform
move_3 = Move(Geometry=point_29, Motion=multiplication_5)  # -> Geometry, Transform

# ----
# transformed inner points
point_31 = Point(move_2.Geometry)

# ----
# transformed inner points
point_32 = Point(move_3.Geometry)

merge_2 = Merge(Data1=point_28, Data2=point_31)
merge_3 = Merge(Data1=point_32, Data2=point_27)
line = Line(StartPoint=merge_2, EndPoint=merge_3)

# ----
# generated morphed voronoi lines
curve_13 = Curve(line)

# ----
# Sphere packing constraints
length = Length(Curve=curve_10)
division_2 = Division(A=number_slider_8, B=Slider(1, range=0..10))
spherecollide = SphereCollide(Centers=point_15, Radius=division_2)

maximum = Maximum(A=number_slider_8, B=length)
number_6 = Number(number_slider_8)

springsfromline = SpringsFromLine(
    Connection=curve_10,
    Stiffness=1000,
    Damping=Slider(12, range=0..1000),
    RestLength=number_6,
    UpperCutoff=0,
    LowerCutoff=number_6,
    Plasticity=0)

merge_4 = Merge(
    Data1=flatten(bend),
    Data2=pulltomesh,
    Data3=spherecollide,
    Data4=flatten(curvepull),
    Data5=springsfromline,
    Data6=collidemesh)

# ----
# Kangaroo (Zmb) Engine
number_slider_16 = Slider(100, range=0..100)
zombiekangaroo = ZombieKangaroo(
    ForceObjects=flatten(merge_4),
    AnchorPoints=point_13,
    Settings=null,
    Geometry=point_14,
    Threshold=0.1,
    MaxIters=number_slider_16)  # -> Out, Iterations, ParticlesOut, GeometryOut, KE

# ----
# computed pts
# (the original indices are preserved)
point_33 = Point(zombiekangaroo.GeometryOut)

# ----
# enforce boundary pts preservation
# (snap them to the bdy brep)
# boundary pts (all)
# boundary pts after opt
# containing block
point_34 = Point(point)  # disabled
member_index_3 = MemberIndex(Set=point_16, Member=point_34)  # -> flatten(Index), Count; disabled
list_item_4 = ListItem(List=point_33, Index=member_index_3.Index, Wrap=True)  # disabled
box_2 = Box(box_2pt)  # disabled
point_35 = Point(list_item_4)  # disabled
brep_closest_point_2 = BrepClosestPoint(Point=point_35, Brep=box_2)  # -> Point, Normal, Distance; disabled
replace_items = ReplaceItems(List=point_33, Item=brep_closest_point_2.Point, Indices=member_index_3.Index, Wrap=False)  # disabled

# ----
# enforce boundary pts preservation
# (snap them to the bdy crvs)
# boundary pts after opt
member_index_4 = MemberIndex(Set=point_16, Member=point_17)  # -> Index, Count
shift_paths = ShiftPaths(Data=member_index_4.Index, Offset=-1)
list_item_5 = ListItem(List=point_33, Index=shift_paths, Wrap=True)
point_36 = Point(list_item_5)
curve_closest_point_5 = CurveClosestPoint(Point=point_36, Curve=curve_12)  # -> flatten(Point), Parameter, Distance
integer = Integer(flatten(shift_paths))
replace_items_2 = ReplaceItems(List=point_33, Item=curve_closest_point_5.Point, Indices=integer, Wrap=False)

# ----
# enforce corner anchor pts preservation
# (replace with the original)
# corner anchor pts
point_37 = Point(point_3)
member_index_5 = MemberIndex(Set=point_16, Member=point_37)  # -> flatten(Index), Count
replace_items_3 = ReplaceItems(List=replace_items_2, Item=point_37, Indices=member_index_5.Index, Wrap=False)

point_38 = Point(replace_items_3)
list_item_6 = ListItem(List=point_38, Index=member_index.Index, Wrap=True)
list_item_7 = ListItem(List=point_38, Index=member_index_2.Index, Wrap=True)

# ----
# visualize the translation movement
# all pts
point_39 = Point(point_16)
vector_2pt_5 = Vector2Pt(PointA=point_39, PointB=point_38, Unitize=False)  # -> Vector, Length
sort_list = SortList(Keys=vector_2pt_5.Length)  # -> reverse(Keys), ValuesValuesA
list_item_8 = ListItem(List=sort_list.Keys, Index=0, Wrap=True)
gradient = Gradient(
    LowerLimit=Slider(0, range=0..100),
    UpperLimit=list_item_8,
    Parameter=vector_2pt_5.Length,
    stops=[0: RGB(0, 128, 0), 0.465: RGB(255, 255, 0), 0.984: RGB(255, 0, 0)])
vector_display_ex = VectorDisplayEx(Point=point_39, Vector=vector_2pt_5.Vector, Colour=gradient, Width=Slider(4, range=0..10))

line_2 = Line(StartPoint=list_item_7, EndPoint=list_item_6)

# ----
# visualize the sphere packing
mesh_sphere = MeshSphere(Base=point_38, Radius=division_2, UCount=10, VCount=20)

length_2 = Length(Curve=flatten(line_2))
sort_list_2 = SortList(Keys=length_2)  # -> Keys, ValuesValuesA
list_item_9 = ListItem(List=sort_list_2.Keys, Index=0, Wrap=True)

# ----
# maximum translation
panel_14 = Panel(list_item_8)

# ----
# actual min distance
# (crv length)
panel_15 = Panel(list_item_9)

# ----
# Result crvs
curve_14 = Curve(line_2)

data_dam_2 = DataDam(DataDataA=curve_14, BufferDelay=10000000, BufferMode=0)
curve_15 = Curve(reparameterize(flatten(data_dam_2)))
end_points_4 = EndPoints(Curve=curve_15)  # -> Start, End
merge_5 = Merge(Data1=end_points_4.Start, Data2=end_points_4.End)
remove_duplicate_points = RemoveDuplicatePoints(InputPoints=merge_5, Tolerance=0.001)  # -> OutputPoints, FirstPointIndexes
curve_16 = Curve(curve_15)
point_40 = Point(remove_duplicate_points.OutputPoints)
clean_tree = CleanTree(RemoveNulls=True, RemoveInvalid=True, RemoveEmpty=False, Tree=point_40)
c_script = CSharpScript(crvs=curve_16, pts=clean_tree, tol=0.001)  # -> out, nbgh_crvs, nbgh_point_to_pts, nbgh_crv_ids, e_node_list_ids; inputs crvs: list of Curve, pts: list of Point3d, tol: Double
# ---------- c_script: C# ----------
    DataTree<Line> line_tree = new DataTree<Line>();
    DataTree<Point3d> nbgh_pts = new DataTree<Point3d>();
    DataTree<int> nbgh_e_ids = new DataTree<int>();

    // index by edge id, record end vert ids
    DataTree<int> e_loc_tree = new DataTree<int>();

    // iterate over all the pts
    for(int v_id = 0; v_id < pts.Count; v_id++)
    {
      GH_Path pth = new GH_Path(v_id);
      Point3d p = pts[v_id];

      // iterate over all the lines
      for(int e_id = 0; e_id < crvs.Count; e_id++)
      {
        Curve crv = crvs[e_id];
        Point3d end_u = crv.PointAt(0);
        Point3d end_v = crv.PointAt(1);
        Point3d end_pt = p; // trivial init

        bool is_connected = false;

        if(end_u.DistanceTo(p) < tol)
        {
          end_pt = end_v;
          is_connected = true;
        }
        if(end_v.DistanceTo(p) < tol)
        {
          end_pt = end_u;
          is_connected = true;
        }

        // add pts in the neighbor
        if(is_connected)
        {
          // pth is indexed by vertex's id
          // add the pt to p(id: v_id)'s ngbh
          nbgh_pts.Add(end_pt, pth);
          nbgh_e_ids.Add(e_id, pth);

          // add this line to p's line nbgh
          line_tree.Add(new Line(p, end_pt), pth);

          GH_Path e_loc_pth;
          // if the edge has been created
          if(e_loc_tree.PathExists(new GH_Path(e_id, 0)))
          {
            e_loc_pth = new GH_Path(e_id, 1);
          }
          else
          {
            e_loc_pth = new GH_Path(e_id, 0);
          }

          // orig node id
          e_loc_tree.Add(v_id, e_loc_pth);

          // the current line's id in the orig node's nbgh list
          e_loc_tree.Add(line_tree.Branch(pth).Count - 1, e_loc_pth);
        }
      }
    }

    nbgh_crvs = line_tree;
    nbgh_point_to_pts = nbgh_pts;
    nbgh_crv_ids = nbgh_e_ids;
    e_node_list_ids = e_loc_tree;
# ---------- end c_script ----------

# ----
# first - this end pt's id in the vert list
# second - id in id's line ngbh list
panel_16 = Panel(c_script.e_node_list_ids)

curve_17 = Curve(c_script.nbgh_crvs)
point_41 = Point(c_script.nbgh_point_to_pts)
integer_2 = Integer(c_script.e_node_list_ids)
length_3 = Length(Curve=curve_17)
division_3 = Division(A=length_3, B="2")
list_item_10 = ListItem(List=integer_2, Index=0, Wrap=False)  # -> Item, Item1
negative_3 = Negative(Value=division_3)
extend_curve = ExtendCurve(Curve=curve_17, Type=0, Start=0, End=negative_3)
panel_17 = Panel(list_item_10.Item)
integer_3 = Integer(list_item_10.Item)

# ----
# indexed in node_id
curve_18 = Curve(extend_curve)

# ----
# indexed in crv_id
c_script_2 = CSharpScript(data=curve_18, path=integer_3)  # -> out, A; inputs data: tree, path: tree of Int32
# ---------- c_script_2: C# ----------
    IList<GH_Path> path_data_pths = path.Paths;
    DataTree<object> fetched_tree = new DataTree<object>();

    foreach(GH_Path p_pth in path_data_pths)
    {
      GH_Path d_pth = new GH_Path(path.Branch(p_pth)[0]);

      foreach(Curve d in data.Branch(d_pth))
      {
        fetched_tree.Add(d, p_pth);
      }
    }

    A = fetched_tree;
# ---------- end c_script_2 ----------
list_item_11 = ListItem(List=c_script_2.A, Index=list_item_10.Item1, Wrap=True)

extend_curve_2 = ExtendCurve(Curve=extend_curve, Type=0, Start=0, End=Slider(0.5, range=0..1))
split_tree = SplitTree(Data=list_item_11, Masks=flatten(concatenate_2))  # -> Positive, Negative
split_tree_2 = SplitTree(Data=list_item_11, Masks=flatten(concatenate))  # -> Positive, Negative

# ----
# graspable_part
# (line abstraction)
curve_19 = Curve(extend_curve)
extend_curve_3 = ExtendCurve(Curve=curve_19, Type=0, Start=0, End=negative)

curve_20 = Curve(extend_curve_3)

# ----
# visualize jacks
number_slider_17 = Slider(71, range=0..147)
construct_path_3 = ConstructPath(Indices=number_slider_17)
tree_branch = TreeBranch(Tree=curve_20, Path=construct_path_3, MaintainPaths=True)
pipe = Pipe(Curve=tree_branch, Radius=number_slider_11, Caps=1)

panel_18 = Panel(list_item_11)
pipe_2 = Pipe(Curve=extend_curve_2, Radius=number_slider_11, Caps=1)  # disabled

# ----
# each e in its end_v nbgh
curve_21 = Curve(split_tree_2.Negative)

# ----
# each e in its end_u nbgh
curve_22 = Curve(split_tree_2.Positive)

end_points_5 = EndPoints(Curve=curve_22)  # -> Start, End
extend_curve_4 = ExtendCurve(Curve=curve_22, Type=0, Start=0, End=negative_2)
extend_curve_5 = ExtendCurve(Curve=curve_21, Type=0, Start=0, End=division)
extend_curve_6 = ExtendCurve(Curve=curve_22, Type=0, Start=0, End=division)
point_42 = Point(end_points_5.End)

# ----
# unextended
curve_23 = Curve(reparameterize(extend_curve_4))

curve_24 = Curve(reparameterize(extend_curve_6))
perp_frame = PerpFrame(Curve=curve_23, Parameter=Slider(1, range=0..1))
deconstruct_plane_2 = DeconstructPlane(Plane=perp_frame)  # -> Origin, XAxis, YAxis, ZAxis
vector = Vector(deconstruct_plane_2.ZAxis)
vector_2 = Vector(deconstruct_plane_2.XAxis)
rotate_3d_2 = Rotate3D(Geometry=vector_2, Angle=degrees(Slider(0, range=0..360)), Center=deconstruct_plane_2.Origin, Axis=vector)  # -> Geometry, Transform
vector_3 = Vector(vector)
vector_4 = Vector(rotate_3d_2.Geometry)

# ----
# plug in different geometry here
# if we want to use another type of connection
center_box = CenterBox(Base=perp_frame, X=number_2, Y=1, Z=number_slider_12)

multiplication_6 = Multiplication(A=number_slider_12, B=vector_3)
multiplication_7 = Multiplication(A=number_3, B=vector_4)
addition = Addition(A=multiplication_7, B=multiplication_6)
move_4 = Move(Geometry=center_box, Motion=addition)  # -> Geometry, Transform
pipe_3 = Pipe(Curve=curve_24, Radius=number_2, Caps="1")
brep_5 = Brep(pipe_3)
pipe_4 = Pipe(Curve=extend_curve_5, Radius=number_2, Caps="1")
brep_6 = Brep(move_4.Geometry)
stream_filter = StreamFilter(Gate=Toggle(False), Stream1=brep_5)
solid_difference = SolidDifference(BrepsA=stream_filter, BrepsB=brep_6)
brep_7 = Brep(pipe_4)
stream_filter_2 = StreamFilter(Gate=Toggle(False), Stream1=brep_7)
brep_8 = Brep(solid_difference)
solid_difference_2 = SolidDifference(BrepsA=stream_filter_2, BrepsB=brep_8)

# ----
# end_v joint
brep_9 = Brep(solid_difference_2)

# ----
# end_u joint
brep_10 = Brep(brep_8)

merge_6 = Merge(Data1=brep_10, Data2=brep_9)  # -> simplify(Result)
data_dam_3 = DataDam(DataDataA=merge_6, BufferDelay=10000000, BufferMode=0)

# ----
# examine each element
number_slider_18 = Slider(104, range=0..291)
concatenate_3 = Concatenate(A="{", Fragment_A=number_slider_18, C=";", B="*", Fragment_B="}")
split_tree_3 = SplitTree(Data=merge_6, Masks=flatten(concatenate_3))  # -> Positive, Negative

# ----
# first - this end pt's id in the vert list
# second - id in id's line ngbh list
integer_4 = Integer(c_script.e_node_list_ids)

brep_11 = Brep(data_dam_3)
panel_19 = Panel(integer_4)
c_script_3 = CSharpScript(data=brep_11, path=integer_4)  # -> out, A; inputs data: tree, path: tree of Int32
# ---------- c_script_3: C# ----------
    IList<GH_Path> path_data_pths = path.Paths;
    DataTree<object> created_tree = new DataTree<object>();

    foreach(GH_Path p_pth in path_data_pths)
    {
      // [0]: vert id; [1]: edge id in vert's line nbhd list
      GH_Path d_pth = new GH_Path(path.Branch(p_pth)[0], path.Branch(p_pth)[1]);

      foreach(var d in data.Branch(p_pth))
      {
        created_tree.Add(d, d_pth);
      }
    }

    A = created_tree;
# ---------- end c_script_3 ----------
shift_paths_2 = ShiftPaths(Data=c_script_3.A, Offset=-1)
point_43 = Point(clean_tree)
curve_25 = Curve(curve_16)
curve_26 = Curve(extend_curve_3)

# ----
# shape scaling & translation
cluster_2 = Cluster_2(geometry=curve_25, factor=scale_factor, x_coordinate=x_axis_transl, y_coordinate=number_4, z_coordinate=number_5)
cluster_3 = Cluster_2(geometry=curve_26, factor=scale_factor, x_coordinate=x_axis_transl, y_coordinate=number_4, z_coordinate=number_5)
cluster_4 = Cluster_2(geometry=brep_3, factor=scale_factor, x_coordinate=x_axis_transl, y_coordinate=number_4, z_coordinate=number_5)
cluster_5 = Cluster_2(geometry=point_43, factor=scale_factor, x_coordinate=x_axis_transl, y_coordinate=number_4, z_coordinate=number_5)

brep_12 = Brep(cluster_4)
curve_27 = Curve(simplify(graft(cluster_2)))
point_44 = Point(simplify(graft(cluster_5)))
group = Group(Objects=brep_12)
curve_28 = Curve(flatten(curve_27))
split_tree_4 = SplitTree(Data=point_44, Masks=flatten(construct_path))  # -> Positive, Negative
split_tree_5 = SplitTree(Data=group, Masks=flatten(construct_path))  # -> Positive, Negative

# ----
# jack-center line abstration
# (indexed by verts)
curve_29 = Curve(cluster_3)

# ----
# grasp poses generation
# (in place scene)
# angle discretization
number_slider_19 = Slider(90, range=0..90)
number_slider_20 = Slider(45, range=0..147)
division_4 = Division(A=number_slider_19, B="360")
pi_2 = Pi(Factor=division_4)
division_5 = Division(A="360", B=number_slider_19)
perp_frame_2 = PerpFrame(Curve=reparameterize(curve_29), Parameter=Slider(0.7, range=0..1))
construct_path_4 = ConstructPath(Indices=number_slider_20)
series_2 = Series(Start=0, Step=number_slider_19, Count=division_5)
brep_13 = Brep(brep_12)
rotate_plane = RotatePlane(Plane=simplify(graft(perp_frame_2)), Angle=degrees(series_2))
concatenate_4 = Concatenate(A="{", Fragment_A=number_slider_20, Fragment_B=";*}")
split_tree_6 = SplitTree(Data=rotate_plane, Masks=flatten(concatenate_4))  # -> Positive, Negative
plane = Plane(rotate_plane)
shift_paths_3 = ShiftPaths(Data=plane, Offset=-1)
tree_branch_2 = TreeBranch(Tree=brep_13, Path=construct_path_4, MaintainPaths=True)
tree_branch_3 = TreeBranch(Tree=shift_paths_3, Path=construct_path_4, MaintainPaths=True)
tree_branch_4 = TreeBranch(Tree=curve_29, Path=construct_path_4, MaintainPaths=True)

data = Data(split_tree_5.Positive)
point_45 = Point(split_tree_4.Positive)
tree_branch_5 = TreeBranch(Tree=data, Path=construct_path_2, MaintainPaths=True)
tree_branch_6 = TreeBranch(Tree=point_45, Path=construct_path_2, MaintainPaths=True)
ungroup = Ungroup(Group=data)  # -> simplify(Objects)

# ----
# create sub-graph lines from vertices
ghpython_script_2 = GhPythonScript(sub_graph_vertices=flatten(point_45), full_graph_lines=curve_28)  # -> out, sub_graph_lines; inputs sub_graph_vertices: list of Point3d, full_graph_lines: list of Curve
# ---------- ghpython_script_2: Python ----------
import ghpythonlib.components as ghcomp

from compas.datastructures import Network
from compas.geometry import Point, Line
from compas.geometry import distance_point_point
from compas_ghpython import xdraw_lines
from timber_workshop_robarch.utilities import *

###########################
def subgraph_from_vertices(net, vert_ids):
    """
    Simply sweep over the edge set.
    
    Parameters
    ----------
    net: compas.ds.Network
    vert_ids: a list of vert ids
    
    Returns
    -------
    """
    edge_list = []
    for e in net.edges():
        u, v = e
        if (u in vert_ids) and (v in vert_ids):
            edge_list.append((u,v))
        
#    vert_list = [net.vertex_coordinates(id) for id in vert_ids]
    
    return Network.from_vertices_and_edges(net.to_points(), edge_list)

###########################

input_lines = []
for crv in full_graph_lines:
    end_pt_1, end_pt_2 = ghcomp.EndPoints(crv)
    # convert rhino pt to compas pt
    input_lines.append([rPt2cPt(end_pt_1), rPt2cPt(end_pt_2)])
    
sub_vert = [rPt2cPt(p) for p in sub_graph_vertices]
net = Network.from_lines(input_lines)

sub_vert_ids = []
for i in range(net.number_of_vertices()):
    for t in sub_graph_vertices:
        if distance_point_point(net.vertex_coordinates(i), t) < 1e-3:
            sub_vert_ids.append(i)

sub_net = subgraph_from_vertices(net, sub_vert_ids)
#print(sub_net.to_points())
sub_graph_lines = get_network_rhino_axes(sub_net)

#xdraw_lines(sub_graph_lines)
#sub_graph = Network.from_vertices_and_edges(sub_vert, sub_vert_ids)
# ---------- end ghpython_script_2 ----------

# ----
# object in_scene place pose
# temp/naiive way of creating world_from_obj_pose
bounding_box = BoundingBox(Content=ungroup, Plane=PlaneXY(0, 0, 0), UnionBox=True)  # -> Box, Box_2
deconstruct_brep_3 = DeconstructBrep(Brep=bounding_box.Box)  # -> Faces, Edges, simplify(Vertices)
average = Average(Input=deconstruct_brep_3.Vertices)
point_46 = Point(average)
xy_plane_4 = XYPlane(Origin=point_46)  # -> flatten(Plane)

# ----
# object in_scene pick pose
number_slider_21 = Slider(-286, range=-700..700)
construct_point_2 = ConstructPoint(XCoordinate=Slider(436, range=0..700), YCoordinate=number_slider_21, ZCoordinate=Slider(0, range=0..700))
plane_origin = PlaneOrigin(Base=xy_plane_4, Origin=construct_point_2)

mesh_brep = MeshBrep(
    Brep=ungroup,
    Settings={GridMaxCount=0, GridMinCount=16, JaggedSeams=False, MaxEdgeLength=0, MinEdgeLength=0.0001, MinTolerance=0, Refine=True, RefineAngle=0, RelativeTolerance=0.65, SimplePlanes=True, Tolerance=0})

# ----
# connectivity network
point_47 = Point(flatten(point_45))
curve_30 = Curve(ghpython_script_2.sub_graph_lines)

# ----
# tree branch index
# corresponds to network vert id
mesh = Mesh(mesh_brep)

# ----
# grasp poses (world_from)
# indexed by verts
plane_2 = Plane(shift_paths_3)

# ----
# ee pose needs to be redefined
plane_3 = Plane(xy_plane_4)
plane_4 = Plane(plane_origin)
ghpython_script_3 = GhPythonScript(
    network_lines=curve_30,
    network_vertices=point_47,
    assembly_objects=mesh,
    world_from_place_poses=plane_3,
    world_from_pick_poses=plane_4,
    world_from_grasp_poses=plane_2,
    base_frame=xy_plane_2,
    file_path=panel_12,
    pkg_name="3D_voronoi_jacks",
    assembly_type="picknplace",
    model_type="3D_discrete_objs",
    unit="millimeter",
    generate=generate_pkg)  # -> out, simplify(a), b, c; inputs network_lines: list of Curve, network_vertices: list of Point3d, assembly_objects: tree of Mesh, world_from_place_poses: list of Plane, world_from_pick_poses: list of Plane, world_from_grasp_poses: tree of Plane, base_frame: Plane, generate: Boolean
# ---------- ghpython_script_3: Python ----------
"""Creates an AssemblyNetwork and creates a problem instance pkg for stripstream
    
    Inputs
    ------
    network_lines: a list of rg.Curve
    network_vertices: a list of rg.Point3d
        this list must be indexed correponding to the tree branch in
        assembly objects
    assembly_objects: a DataTree of rg.Mesh
    
    assembly_object_poses:
        
    world_from_grasp_pose
    Outputs
    -------
        a: The a output variable"""

__author__ = "yijiangh"
__version__ = "2019.01.26"

import sys
import copy
import os
import json
from collections import OrderedDict

import Rhino.Geometry as rg
import ghpythonlib.components as ghcomp
import ghpythonlib.treehelpers as th

from compas.datastructures import Mesh, Network
from compas.geometry import Frame, Point
from compas.geometry import Transformation, transform_points, cross_vectors
from compas_ghpython import xdraw_mesh, xdraw_frame

# some useful rg<->compas conversion util fns
from timber_workshop_robarch.utilities import *

##########################################
def tree_to_lists(input):
    """converts a depth-2 GH datatree to a list of lists
    """
    all = []
    for path in input.Paths:
        branch_list = []
        for obj in input.Branch(path):
            branch_list.append(obj)
        all.append(branch_list)
    return all

def rPln2cFrame(rplane):
    """converts a rhino plane to compas frame
    """
    return Frame(rplane.Origin, rplane.XAxis, rplane.YAxis)

def transform_cmesh(cmesh, ctf):
    """transform a compas mesh
    Paramters
    ---------
    cmesh: a compas mesh
    ctf: a compas transformation
    """
    verts, faces = cmesh.to_vertices_and_faces()
    for i, v in enumerate(verts):
        v_tf = transform_points([v], ctf)[0]
        cmesh.set_vertex_attributes(i, ['x','y','z'], v_tf)
    return cmesh

def network_from_rg_pts_and_lines(vertices, lines, tol=1e-3):
    """create a compas network using given rhino pts and lines
    
    Paramters
    ---------
    vertices: list of rh.point3d
    edges: list of rh.curve
    
    Returns
    -------
    """
    net_lines = []
    for crv in lines:
        rg_end_pt_1, rg_end_pt_2 = ghcomp.EndPoints(crv)
        end_1_id = -1
        end_2_id = -1
        
        # convert rhino pt to compas pt
        for v_id, v in enumerate(vertices):
            if rg_end_pt_1.DistanceTo(v) < tol:
                end_1_id = v_id
            if rg_end_pt_2.DistanceTo(v) < tol:
                end_2_id = v_id
        
        assert((end_1_id != -1) \
        and (end_2_id != -1) \
        and (end_1_id != end_2_id))
        
        net_lines.append((end_1_id, end_2_id))
    
    cp_verts = [rPt2cPt(rpt) for rpt in vertices]
    return Network.from_vertices_and_edges(cp_verts, net_lines)
    
def draw_assembly_object_cmeshes(as_o, stage="place"):
    """
    Parameters:
        as_o: AssemblyObject
        stage: flag for 'place', 'pick'
    """
    if stage == "place":
        return [xdraw_mesh(*cm.to_vertices_and_faces()) for cm in as_o.shape_in_place_pose]
    elif "pick":
        return [xdraw_mesh(*cm.to_vertices_and_faces()) for cm in as_o.shape_in_pick_pose]
    else:
        return None

# -----------------
# json export utils
# -----------------
def obj_name(obj_id, sub_id):
    name = "object_" + str(obj_id) + "-" + str(sub_id) + ".obj"
    return name

def cframe2json(cfr):
    """
    Parameters
    ----------
    cfr: compas frame
    """
    dict = OrderedDict()
    dict["XAxis"] = cfr.to_data()["xaxis"]
    dict["YAxis"] = cfr.to_data()["yaxis"]
    dict["ZAxis"] = cross_vectors(dict["XAxis"], dict["YAxis"])
    dict["Origin"] = cfr.to_data()["point"]
    return dict

##########################################
WORLD_FRAME = Frame.worldXY()

class AssemblyObject(object):
    """assembly object that embodies geometry, geometry pose, grasp pose
    
    Attributes
    ----------
    base_frame: compas.geometry.Frame
        The frame that the data is associated with/described in.
        Defaults to be the 'base_link' (world xyz).
    id: string
        The id of the object, usually an int index of the object
    shape: compas.geometry.Mesh
        The assembly object's geometry, the mesh vertices coordinates are
        associated to the 'base_link' (world xyz)
    shape_pick_pose: compas.geometry.Frame
        The shape's pose to be picked described in the associated base_frame
    shape_place_pose: compas.geometry.Frame 
        The shape's pose to be placed described in the associated base_frame
    shape_time_stamped_pose: dict{float : compas.geometry.Frame}
        current shape pose
    object_from_ee_poses: list of compas.geometry.Frame
        The end effector (ee/gripper) grasp poses described in the object's 
        shape_pose frame.
    """
    
    def __init__(self, base_frame=WORLD_FRAME, id=-1, \
        shape=None, shape_place_pose=None):
        """
        
        Parameters
        ----------
            base_frame: compas.geometry.Frame
                Defaults to the world xyz
            id: int
                Defaults to be -1
            shape: compas.geometry.Mesh
                Defaults to be None
        """
        self.base_frame = base_frame
        self.id = id
        self.shape = shape
        self.shape_place_pose = None
        self.shape_pick_pose = None
    # --------------
    # constructors
    # --------------
    @classmethod
    def create_from_object_place_pose(cls, id, rbase_frame, \
            rgeometry_in_scene, rpose_in_scene):
        """create object from geometry in a scene pose
        
        We perform transformation here to orient the geometry back to
        the base_link
        
        Parameters
        ----------
        rbase_frame : rhion plane
        rgeometry_in_scene: list of rhino meshes
        rpose_in_scene: rhino planes
        """
        as_obj = cls()
        as_obj.base_frame = rPln2cFrame(rbase_frame)
        as_obj.shape_place_pose = rPln2cFrame(rpose_in_scene)
        
        # perform transformation on the geometry_in_scene
        obj_tf = Transformation.from_frame(as_obj.shape_place_pose)
        
        cmesh_tf = [transform_cmesh(rMesh2cMesh(rm), obj_tf.inverse()) \
                for rm in rgeometry_in_scene]
        
        as_obj.shape = cmesh_tf
        
        return as_obj
        
    # --------------
    # attributes assigners
    # --------------
    def set_pick_in_scene_pose(self, rpick_plane):
        self.shape_pick_pose = rPln2cFrame(rpick_plane)
        
    def set_place_in_scene_pose(self, rplace_plane):
        self.shape_place_pose = rPln2cFrame(rplace_plane)
        
    def set_ee_poses_from_in_scene_poses(self, rworld_from_obj_pose, rworld_from_ee_poses):
        """create obj_from_grasp poses from world
        
        Parameters
        ----------
        rworld_from_obj_pose: rhino plane
        rworld_from_ee_poses: a list of rhino plane
        """
        world_obj_tf = Transformation.from_frame( \
            rPln2cFrame(rworld_from_obj_pose))
        
        self.object_from_ee_poses = []
        for world_ee_fr in [rPln2cFrame(rw_ee) for rw_ee in rworld_from_ee_poses]:
            w_ee_tf = Transformation.from_frame(world_ee_fr)
            self.object_from_ee_poses.append(Frame.from_transformation( \
                Transformation.concatenate(world_obj_tf.inverse(), w_ee_tf)))
                
        
    def set_ee_place_poses_from_obj(self, obj_from_ee_poses):
        assert(False, "not implemented")
    
    @property
    def world_from_pick_ee_poses(self):
        """return a list of (world_from) ee pick poses
        """
        assert(self.shape_pick_pose != None, "pick pose not defined!")
        world_from_ee_pick = []
        world_pick_tf = Transformation.from_frame(self.shape_pick_pose)
        for obj_from_ee in self.object_from_ee_poses:
            w_f_ee_tf = Transformation.concatenate(world_pick_tf, Transformation.from_frame(obj_from_ee))
            world_from_ee_pick.append(Frame.from_transformation(w_f_ee_tf))
        return world_from_ee_pick
    
    @property
    def world_from_place_ee_poses(self):
        """return a list of (world_from) ee place poses
        """
        assert(self.shape_place_pose != None, "place pose not defined!")
        world_from_ee_place = []
        world_place_tf = Transformation.from_frame(self.shape_place_pose)
        for obj_from_ee in self.object_from_ee_poses:
            w_f_ee_tf = Transformation.concatenate(world_place_tf, Transformation.from_frame(obj_from_ee))
            world_from_ee_place.append(Frame.from_transformation(w_f_ee_tf))
        return world_from_ee_place
        
    @property
    def shape_in_pick_pose(self):
        """return shape geometries in pick pose"""
        assert(self.shape_pick_pose != None, "pick pose not defined!")
        world_pick_tf = Transformation.from_frame(self.shape_pick_pose)
        return [transform_cmesh(cm, world_pick_tf) for cm in self.shape]
#        return [cm for cm in self.shape]
    
    @property
    def shape_in_place_pose(self):
        """return shape geometries in pick pose"""
        assert(self.shape_place_pose != None, "place pose not defined!")
        world_place_tf = Transformation.from_frame(self.shape_place_pose)
        return [transform_cmesh(cm, world_place_tf) for cm in self.shape]
        
class AssemblyNetwork(Network):
    """
    
    Attributes
    ----------
        
    """
    def __init__(self):
        super(AssemblyNetwork, self).__init__()
    
    # --------------
    # constructors
    # --------------
    @classmethod
    def from_network(cls, net):
        as_net = cls()
        as_net.vertex = net.vertex 
        as_net.edge = net.edge
        as_net.halfedge = net.halfedge
        as_net.attributes = net.attributes
        return as_net
        
    @classmethod
    def from_network_and_assembly_objects(cls, net, objs):
        assert(net.number_of_vertices()==len(objs), \
            "assembly objects and network vertices not aligned!")
        as_net = cls.from_network(net)
        
        # assign assembly object attribute
        for i, vert_key in enumerate(as_net.vertices()):
            objs[i].id = i
            as_net.set_vertex_attribute(vert_key, "assembly_object", objs[i])
        return as_net
    
    # --------------
    # properties getters
    # --------------
    @property
    def assembly_objects(self):
        return [self.get_vertex_attribute(v, "assembly_object") \
            for v in self.vertices()]
    
    def assembly_object(self, vert_id):
        return self.assembly_objects[vert_id]
        
    # --------------
    # exporters
    # --------------
    def save_assembly_object_to_objs(self, mesh_path):
        if not os.path.isdir(mesh_path):
            os.mkdir(mesh_path)
            
        for as_obj in self.assembly_objects:
            for i, s in enumerate(as_obj.shape):
                s.to_obj(os.path.join(mesh_path, obj_name(as_obj.id, i)))
        
    def save_assembly_network_to_json(self, json_path, pkg_name='', \
            assembly_type='', model_type='', unit=''):
        if not os.path.isdir(json_path):
            os.mkdir(json_path)
        
        json_file_path = os.path.join(json_path, pkg_name + '.json')
        
        data = OrderedDict()
        data['pkg_name'] = pkg_name
        data['assembly_type'] = assembly_type
        data['model_type'] = model_type
        data['unit'] = unit
        
        data['element_number'] = self.number_of_vertices()
        data['sequenced_elements'] = []
        
        for v in self.vertices():
            assert(v == self.assembly_object(v).id)
            ao = self.assembly_object(v)
            
            e_data = OrderedDict()
            e_data['order_id'] = v
            e_data['base_frame'] = cframe2json(ao.base_frame)
            e_data['element_geometry_file_names'] = [obj_name(v, sub_id) \
                for sub_id in range(len(ao.shape))]
            
            grasp_data = OrderedDict()
            grasp_data['parent_link'] = 'object' #world
            grasp_data['ee_poses'] = [cframe2json(ee_p) \
                for ee_p in ao.object_from_ee_poses]
            
            pick = OrderedDict()
            pick['process_name'] = 'pick'
            pick['base_frame'] = cframe2json(ao.base_frame)
            pick['target_pose'] = cframe2json(ao.shape_pick_pose)
            pick['allowed_collision_obj_names'] = [] # support tables
            
            place = OrderedDict()
            place['process_name'] = 'place'
            place['base_frame'] = cframe2json(ao.base_frame)
            place['target_pose'] = cframe2json(ao.shape_place_pose)
            place['allowed_collision_obj_names'] = [] # support tables
            for nghb_id in self.vertex_neighborhood(v):
                place['allowed_collision_obj_names'].extend(
                    [obj_name(nghb_id, sub_id) \
                        for sub_id in range(len(self.assembly_object(nghb_id).shape))])
            
            grasp_data['processes'] = [pick, place]
            e_data['grasps'] = grasp_data
            
            data['sequenced_elements'].append(e_data)
        
        with open(json_file_path, 'w') as outfile:  
            json.dump(data, outfile, indent=4)
            
    def save_assembly_network_to_urdf(self, urdf_path):
        pass
        
    def save_to_stripstream_pkg(self, save_path, pkg_name, \
        assembly_type="", model_type="", unit=""):
        root_path = os.path.join(save_path, pkg_name)
        if not os.path.isdir(root_path):
            os.mkdir(root_path)
        
        json_path = os.path.join(root_path, "json")
        mesh_path = os.path.join(root_path, "meshes", "collision")
        urdf_path = os.path.join(root_path, "urdf")
        check_paths = [json_path, mesh_path, urdf_path]
        for p in check_paths:
            if not os.path.isdir(p):
                os.mkdir(p)
                
        # generate obj files
        self.save_assembly_object_to_objs(mesh_path)
        
        # generate json
        self.save_assembly_network_to_json(json_path, pkg_name, assembly_type, model_type, unit)
        
        # genereate urdf
#        self.save_assembly_network_to_urdf(urdf_path)

########################################
# main
a = []
b = []
c = []

# temp drawing
tf_meshes = []

line_net = network_from_rg_pts_and_lines(network_vertices, network_lines)
#a = get_network_rhino_axes(line_net)

# create assembly objects
obj_lists = tree_to_lists(assembly_objects)
grasp_pose_lists = tree_to_lists(world_from_grasp_poses)
as_objs = []

for i, obj_list in enumerate(obj_lists):
    as_obj = AssemblyObject.create_from_object_place_pose( \
        str(i), base_frame,
        obj_list, world_from_place_poses[i])
    as_obj.set_pick_in_scene_pose(world_from_pick_poses[i])
    as_obj.set_ee_poses_from_in_scene_poses(world_from_place_poses[i], grasp_pose_lists[i])
    
    as_objs.append(as_obj)

as_o = as_objs[0]
#print(as_o.shape_pick_pose.to_data())
#a = xdraw_frame(as_o.shape_pick_pose)
#b = [xdraw_mesh(*cm.to_vertices_and_faces()) for cm in as_o.shape_in_pick_pose]
#c = [xdraw_frame(ee) for ee in as_o.world_from_pick_ee_poses]

assembly_net = AssemblyNetwork.from_network_and_assembly_objects(line_net, as_objs)

if generate:
    assembly_net.save_to_stripstream_pkg(file_path, pkg_name, assembly_type, model_type, unit)

## inspect vertices in neighborhood
#v_id = 1
#v_nbhd = assembly_net.vertex_neighborhood(v_id)
#for v in v_nbhd:
#    as_o_nbgh = assembly_net.get_vertex_attribute(v, "assembly_object")
#    a.extend(draw_assembly_object_cmeshes(as_o_nbgh))
#    
#b = draw_assembly_object_cmeshes(assembly_net.get_vertex_attribute(v_id, "assembly_object"))
# ---------- end ghpython_script_3 ----------
data_2 = Data(ghpython_script_3.a)
data_3 = Data(ghpython_script_3.b)
panel_20 = Panel(ghpython_script_3.out)

# ==== cluster Cluster
line = ClusterInput()
remove_duplicate_lines_karamba = RemoveDuplicateLinesKaramba(Line=flatten(line), LimitDistance=0.005)  # -> OutLine, Info, Indexes
scale = Scale(Geometry=remove_duplicate_lines_karamba.OutLine, Center=Point(0, 0, 0), Factor=Slider(10, range=0..10))  # -> Geometry, Transform
removeduplicatelines = RemoveDuplicateLines(Lines=scale.Geometry, Tolerance=Slider(0.05, range=0..0.1))
end_points = EndPoints(Curve=removeduplicatelines)  # -> Start, End
merge = Merge(Data1=end_points.Start, Data2=end_points.End)
create_set = CreateSet(List=merge)  # -> Set, Map
number_slider = Slider(1, range=0..1)
member_index = MemberIndex(Set=create_set.Set, Member=end_points.End)  # -> Index, Count
member_index_2 = MemberIndex(Set=create_set.Set, Member=end_points.Start)  # -> Index, Count
deconstruct = Deconstruct(Point=create_set.Set)  # -> XComponent, YComponent, ZComponent
addition = Addition(A=member_index_2.Index, B=number_slider)
addition_2 = Addition(A=member_index.Index, B=number_slider)
integer = Integer(addition)
integer_2 = Integer(addition_2)
concatenate = Concatenate(Fragment_A="l", Fragment_B=" ", A=integer, B=" ", C=integer_2)  # -> flatten(Result)
concatenate_2 = Concatenate(
    Fragment_A="v",
    G=" ",
    Fragment_B=deconstruct.XComponent,
    A=" ",
    B=deconstruct.YComponent,
    C=" ",
    D=deconstruct.ZComponent)  # -> flatten(Result)
merge_2 = Merge(Data1=concatenate_2, Data2=concatenate)
panel = Panel(merge_2)

# ==== cluster Cluster_2
geometry = ClusterInput()
factor = ClusterInput()
scale = Scale(Geometry=geometry, Center=Point(0, 0, 0), Factor=factor)  # -> Geometry, Transform
x_coordinate = ClusterInput()
y_coordinate = ClusterInput()
z_coordinate = ClusterInput()
rotate_axis = RotateAxis(Geometry=scale.Geometry, Angle=1.570796327, Axis=Line((0, 0, 0), (10, 0, 0)))  # -> Geometry, Transform
construct_point = ConstructPoint(XCoordinate=x_coordinate, YCoordinate=y_coordinate, ZCoordinate=z_coordinate)
move = Move(Geometry=rotate_axis.Geometry, Motion=construct_point)  # -> Geometry, Transform
geometry_2 = ClusterOutput(move.Geometry)
